# Grasshopper definition smorgasbord video.gh (Grasshopper 1.0.7)
# plug-ins: Human, Firefly.X, Firefly.Core

number_slider = Slider(64, range=0..1000)  # disabled
barbz = FilePath("D:\GitHub\Smorgasbord\src\content\modules\21-parametric-visualization-with-grasshopper\assets\sherman\sherman-cindy_untitled-70_1980.jpg")  # disabled
img = ImportImage(File=barbz, XSamples=number_slider, YSamples=number_slider)  # disabled
number_slider_2 = Slider(1.75, range=0..10)  # disabled
number_slider_3 = Slider(0.75, range=0..1)  # disabled

# ---- group: CUTTING PLANE
number_slider_4 = Slider(26, range=0..1000)  # disabled
xy = XYPlane(Origin=Point(0, 0, 0))  # disabled
Z = UnitZ(Factor=number_slider_2)  # disabled
move = Move(Geometry=xy, Motion=Z)  # -> Geometry, Transform; disabled

# ----
demesh = DeconstructMesh(Mesh=img)  # -> Vertices, Faces, Colours, Normals; disabled
number_slider_5 = Slider(56, range=0..100)  # disabled
sec = MeshPlane(Plane=move.Geometry)  # disabled
ahsv = SplitAHSV(Colour=demesh.Colours)  # -> Alpha, Hue, Saturation, Value; disabled
join = JoinCurves(Preserve=False)  # disabled

# ---- group: FILTER LINES BY LENGTH
len = Length(Curve=join)  # disabled
larger = LargerThan(FirstNumber=len, SecondNumber=number_slider_5)  # -> LargerThan, OrEqualTo; disabled
dispatch = Dispatch(List=join, DispatchPattern=larger.LargerThan)  # -> ListA, ListB; disabled

# ----
panel = Panel("0,0,0")  # disabled
number_slider_6 = Slider(3, range=0..10)  # disabled
swatch = ColourSwatch(SwatchColor=RGB(255, 0, 0))  # disabled
addition = Addition(A=ahsv.Saturation, B=ahsv.Value)  # disabled
cir = Circle(Plane=panel, Radius=1)  # disabled
lng = ListLength(List=demesh.Colours)  # disabled
geo = Geometry(sec)  # disabled
panel_2 = Panel("2")  # disabled
division = Division(A=addition, B=panel_2)  # disabled
number_slider_7 = Slider(1000, range=0..1000)  # disabled
previewlw = CustomPreviewLineweights(Geometry=geo, Shader=swatch, Thickness=number_slider_6, Absolute=False)  # disabled
number_slider_8 = Slider(24, range=0..1000)  # disabled
hsv = ColourHSV(Alpha=1, Hue=ahsv.Hue, Saturation=1, Value=1)  # disabled
divide = DivideCurve(Curve=cir, Count=lng, Kinks=False)  # -> Points, Tangents, Parameters; disabled
sort = SortList(Keys=ahsv.Hue, ValuesA=division)  # -> Keys, ValuesA; disabled
sort_2 = SortList(Keys=ahsv.Hue, ValuesA=hsv)  # -> Keys, ValuesA; disabled
vec2pt = Vector2Pt(PointA=panel, PointB=divide.Points, Unitize=True)  # -> Vector, Length; disabled
multiplication = Multiplication(A=number_slider_7, B=sort.ValuesA)  # disabled
video_stream = WebCamVideoStream()
smooth = SmoothingMovingAverage(Number=multiplication, Samples=number_slider_8)  # disabled
line = LineSDL(Start=panel, Direction=vec2pt.Vector, Length=smooth)  # disabled
number_slider_9 = Slider(3, range=0..10)  # disabled

# ---- group: CUTTING PLANE
xy_2 = XYPlane(Origin=Point(0, 0, 0))
Z_2 = UnitZ(Factor=Slider(0.4, range=0..3))
move_2 = Move(Geometry=xy_2, Motion=Z_2)  # -> Geometry, Transform

# ----
mesh = MeshFromImage(Bmp=video_stream, Sx=Domain(0, 24), Sy=Domain(0, 18), Z=1, C=True)
previewlw_2 = CustomPreviewLineweights(Geometry=line, Shader=sort_2.ValuesA, Thickness=number_slider_9, Absolute=False)  # disabled
sec_2 = MeshPlane(Mesh=mesh, Plane=move_2.Geometry)

# ---- group: MARK
previewlw_3 = CustomPreviewLineweights(
    Geometry=sec_2,
    Shader={diffuse=RGB(255, 105, 180), emission=RGB(76, 32, 54), shine=0.5, specular=RGB(255, 255, 255), transparency=0},
    Thickness=Slider(7, range=0..10),
    Absolute=False)

# ---- group: FIND CENTER OF LARGEST AREA
area = Area(Geometry=sec_2)  # -> Area, Centroid
sort_3 = SortList(Keys=area.Area, ValuesA=area.Centroid)  # -> Keys, ValuesA
item = ListItem(List=sort_3.ValuesA, Index="-1", Wrap=True)

# ---- group: CREATE LINE COLORS
range = Range(Domain=Domain(0, 1), Steps=Slider(100, range=0..1000))  # -> reverse(Range)
gradient = Gradient(
    LowerLimit=0,
    UpperLimit=1,
    Parameter=range,
    stops=[0: RGB(234, 38, 0), 0.25: RGB(234, 126, 0), 0.5: RGB(254, 244, 84), 0.75: RGB(173, 203, 249), 1: RGB(75, 107, 169)])

# ----
rec = DataRecorder(item, DataLimit=-10, RecordData=False)

# ---- group: DRAW LINE DEGMENTS
Z_3 = UnitZ(Factor="10")
move_3 = Move(Geometry=rec, Motion=Z_3)  # -> Geometry, Transform
pline = PolyLine(Vertices=move_3.Geometry, Closed=False)
explode = Explode(Curve=pline, Recursive=True)  # -> Segments, Vertices

# ----
previewlw_4 = CustomPreviewLineweights(Geometry=explode.Segments, Shader=gradient, Thickness=Slider(5, range=0..10), Absolute=False)
