# Grasshopper definition smorgasbord data viz 1.gh (Grasshopper 1.0.7)
# plug-ins: LunchBox, Human

path = FilePath("D:\GitHub\Smorgasbord\src\content\modules\21-parametric-visualization-with-grasshopper\assets\COVID-19_Daily_Counts_of_Cases__Hospitalizations__and_Deaths.csv")
file = ReadFile(File=path, PerLineParse=True)
csv = ReadCSV(CSVString=file, Delimiter=",")  # -> Headers, Values
scaling_multiplier = Slider(0.01, range=0..0.02)
branch = TreeBranch(Tree=csv.Values, Path="0", MaintainPaths=True)
panel = Panel(csv.Headers)

# ---- group: CASE COUNT
branch_2 = TreeBranch(Tree=csv.Values, Path="1", MaintainPaths=True)
lng = ListLength(List=branch_2)
multiplication = Multiplication(A=branch_2, B=scaling_multiplier)
series = Series(Start=0, Step=1, Count=lng)
pt = ConstructPoint(XCoordinate=series, YCoordinate=multiplication, ZCoordinate=0)
pt_2 = ConstructPoint(XCoordinate=series, YCoordinate=0, ZCoordinate="0")
pline = PolyLine(Vertices=pt, Closed=False)
ln = Line(StartPoint=pt, EndPoint=pt_2)
case_count_graph = Geometry(ln)
previewlw = CustomPreviewLineweights(
    Geometry=case_count_graph,
    Shader=ColourSwatch(SwatchColor=RGB(71, 0, 0)),
    Thickness=Slider(1, range=0..10),
    Absolute=False)

# ---- group: 7DAY AVG DEATH COUNT
death_count_scale = Slider(0.5, range=0..1)
branch_3 = TreeBranch(Tree=csv.Values, Path="8", MaintainPaths=True)
multiplication_2 = Multiplication(A=branch_3, B=death_count_scale)
pt_3 = ConstructPoint(XCoordinate=series, YCoordinate=multiplication_2, ZCoordinate="2")
pline_2 = PolyLine(Vertices=pt_3, Closed=False)
_7day_avg_deaths_graph = Geometry(pline_2)
previewlw_2 = CustomPreviewLineweights(
    Geometry=_7day_avg_deaths_graph,
    Shader=ColourSwatch(SwatchColor=RGB(255, 68, 0)),
    Thickness=Slider(2, range=0..10),
    Absolute=False)

# ---- group: 7DAY AVG
branch_4 = TreeBranch(Tree=csv.Values, Path="5", MaintainPaths=True)
multiplication_3 = Multiplication(A=branch_4, B=scaling_multiplier)
pt_4 = ConstructPoint(XCoordinate=series, YCoordinate=multiplication_3, ZCoordinate="1")
pline_3 = PolyLine(Vertices=pt_4, Closed=False)
_7day_avg_graph = Geometry(pline_3)
previewlw_3 = CustomPreviewLineweights(
    Geometry=_7day_avg_graph,
    Shader=ColourSwatch(SwatchColor=RGB(153, 0, 0)),
    Thickness=Slider(3, range=0..10),
    Absolute=False)
