# Grasshopper definition smorgasbord media tests 2.gh (Grasshopper 1.0.7)
# plug-ins: Human

number_slider = Slider(256, range=0..1000)  # disabled
path = FilePath("D:\GitHub\Smorgasbord\src\content\modules\21-parametric-visualization-with-grasshopper\images\3-11 topo data.jpg")  # disabled
img = ImportImage(File=path, XSamples=number_slider, YSamples=number_slider)  # disabled

# ---- group: CUTTING PLANE
xy = XYPlane(Origin=Point(0, 0, 0))
Z = UnitZ(Factor=Slider(26, range=0..1000))
move = Move(Geometry=xy, Motion=Z)  # -> Geometry, Transform

# ---- group: TOPOGRAPHY MESH
number_slider_2 = Slider(512, range=0..1000)
path_2 = FilePath("D:\GitHub\Smorgasbord\src\content\modules\21-parametric-visualization-with-grasshopper\assets\57.10_Kline_F_cropped.jpeg")
img_2 = ImportImage(File=path_2, XSamples=number_slider_2, YSamples=number_slider_2)
demesh = DeconstructMesh(Mesh=img_2)  # -> Vertices, Faces, Colours, Normals
argb = SplitARGB(Colour=demesh.Colours)  # -> Alpha, Red, Green, Blue
multiplication = Multiplication(A=argb.Red, B=Slider(200, range=0..1000))
Z_2 = UnitZ(Factor=multiplication)
move_2 = Move(Geometry=demesh.Vertices, Motion=Z_2)  # -> Geometry, Transform
conmesh = ConstructMesh(Vertices=move_2.Geometry, Faces=demesh.Faces, Colours=demesh.Colours)

# ----
demesh_2 = DeconstructMesh(Mesh=img)  # -> Vertices, Faces, Colours, Normals; disabled
number_slider_3 = Slider(200, range=0..1000)  # disabled
number_slider_4 = Slider(200, range=0..1000)  # disabled

# ---- group: TOPOGRAPHY MESH
number_slider_5 = Slider(512, range=0..1000)  # disabled
path_3 = FilePath("D:\GitHub\Smorgasbord\src\content\modules\21-parametric-visualization-with-grasshopper\images\3-11 topo data.jpg")  # disabled
img_3 = ImportImage(File=path_3, XSamples=number_slider_5, YSamples=number_slider_5)  # disabled
demesh_3 = DeconstructMesh(Mesh=img_3)  # -> Vertices, Faces, Colours, Normals; disabled
argb_2 = SplitARGB(Colour=demesh_3.Colours)  # -> Alpha, Red, Green, Blue; disabled
multiplication_2 = Multiplication(A=argb_2.Red, B=number_slider_4)  # disabled
Z_3 = UnitZ(Factor=multiplication_2)  # disabled
move_3 = Move(Geometry=demesh_3.Vertices, Motion=Z_3)  # -> Geometry, Transform; disabled
conmesh_2 = ConstructMesh(Vertices=move_3.Geometry, Faces=demesh_3.Faces, Colours=demesh_3.Colours)  # disabled

# ----
argb_3 = SplitARGB(Colour=demesh_2.Colours)  # -> Alpha, Red, Green, Blue; disabled
number_slider_6 = Slider(10, range=0..10)  # disabled
multiplication_3 = Multiplication(A=argb_3.Red, B=number_slider_3)  # disabled
Z_4 = UnitZ(Factor=multiplication_3)  # disabled

# ---- group: CUTTING PLANES
dom = ConstructDomain(DomainStart=0, DomainEnd=number_slider_4)  # disabled
range = Range(Domain=dom, Steps=number_slider_6)  # disabled
xy_2 = XYPlane(Origin=Point(0, 0, 0))  # disabled
Z_5 = UnitZ(Factor=range)  # disabled
move_4 = Move(Geometry=xy_2, Motion=Z_5)  # -> Geometry, Transform; disabled

# ----
sec = MeshPlane(Mesh=conmesh, Plane=move.Geometry)
move_5 = Move(Geometry=demesh_2.Vertices, Motion=Z_4)  # -> Geometry, Transform; disabled
join = JoinCurves(Curves=sec, Preserve=False)

# ---- group: TOPO LINE COLORS
range_2 = Range(Domain=Domain(0, 1), Steps=number_slider_6)  # disabled
frgb = ColourRGBF(Alpha=1, Red=range_2, Green=range_2, Blue=range_2)  # -> graft(Colour); disabled

# ----
conmesh_3 = ConstructMesh(Vertices=move_5.Geometry, Faces=demesh_2.Faces, Colours=demesh_2.Colours)  # disabled

# ---- group: FILTER LINES BY LENGTH
len = Length(Curve=join)
larger = LargerThan(FirstNumber=len, SecondNumber=Slider(56, range=0..100))  # -> LargerThan, OrEqualTo
dispatch = Dispatch(List=join, DispatchPattern=larger.LargerThan)  # -> ListA, ListB

# ----
sec_2 = MeshPlane(Mesh=conmesh_2, Plane=move_4.Geometry)  # disabled
geo = Geometry(dispatch.ListA)
previewlw = CustomPreviewLineweights(Geometry=sec_2, Shader=frgb, Absolute=False)  # disabled
previewlw_2 = CustomPreviewLineweights(Geometry=geo, Shader=ColourSwatch(SwatchColor=RGB(255, 0, 0)), Thickness=Slider(3, range=0..10), Absolute=False)
