# Grasshopper definition smorgasbord data geo.gh (Grasshopper 1.0.7)
# plug-ins: LunchBox, Mosquito, Heron

path = FilePath("D:\GitHub\Smorgasbord\src\content\modules\21-parametric-visualization-with-grasshopper\assets\Evictions_20231221_edited_2.csv")  # disabled
file = ReadFile(File=path, PerLineParse=True)  # disabled
path_2 = FilePath("D:\GitHub\Smorgasbord\src\content\modules\21-parametric-visualization-with-grasshopper\assets\nyc-zip-codes.shp")
rec = Rectangle({Plane=PlaneXY(-73.97779953, 40.70582365, 0), Size=Domain2(u=-0.2777886284..0.2777886284, v=-0.2097083179..0.2097083179)})
csv = ReadCSV(CSVString=file, Delimiter=",")  # -> simplify(Headers), Values; disabled
importshp = ImportSHP(Boundary=rec, ShapefileLocation=path_2)  # -> LayerName, ShpFeatureCount, ShpExtent, ShpSpatRef, Fields, Values, FeaturePoints
panel = Panel(path_2)
panel_2 = Panel("12")  # disabled
panel_3 = Panel("13")  # disabled
panel_4 = Panel("16")  # disabled
shp = ImportSHP()  # -> Points, Curves, Regions
branch = TreeBranch(Tree=csv.Values, Path=panel_2, MaintainPaths=True)  # disabled
branch_2 = TreeBranch(Tree=csv.Values, Path=panel_3, MaintainPaths=True)  # disabled
branch_3 = TreeBranch(Tree=csv.Values, Path=panel_4, MaintainPaths=True)  # disabled
xytodd = XYToDecimalDegrees(XyPoint=importshp.FeaturePoints)  # -> Latitude, Longitude
pt = ConstructPoint(XCoordinate=branch_2, YCoordinate=branch, ZCoordinate=0)  # disabled
pt_2 = ConstructPoint(XCoordinate=xytodd.Longitude, YCoordinate=xytodd.Latitude, ZCoordinate=0)
panel_5 = Panel(importshp.FeaturePoints)
toggle = BooleanToggle(True)  # disabled
project_points = MapProject(Points=pt_2, CenterToWorld=Toggle(True))
panel_6 = Panel(csv.Headers)  # disabled
panel_7 = Panel(branch_3)  # disabled
project_points_2 = MapProject(Points=pt, CenterToWorld=toggle)  # disabled
item = ListItem(List=importshp.Values, Index="3", Wrap=True)  # -> flatten(Item)
geo = Geometry(project_points)
pline = PolyLine(Vertices=geo, Closed=False)
int = Integer(item)
geo_2 = Geometry(project_points_2)  # disabled
bnd = Bounds(Numbers=int)
boundary = BoundarySurfaces(Edges=pline)
area = Area()  # -> Area, Centroid
remap = RemapNumbers(Source=Domain(0, 1), Target=Domain(0, 1))  # -> Mapped, Clipped
