# Grasshopper definition smorgasbord data viz 3.gh (Grasshopper 1.0.7)
# plug-ins: LunchBox, Human

# ---- group: Import Data
path = FilePath("D:\GitHub\Smorgasbord\src\content\modules\21-parametric-visualization-with-grasshopper\assets\COVID-19_Daily_Counts_of_Cases__Hospitalizations__and_Deaths.csv")
file = ReadFile(File=path, PerLineParse=True)
csv = ReadCSV(CSVString=file, Delimiter=",")  # -> Headers, Values
panel = Panel(csv.Headers)

# ----
scaling_multiplier = Slider(0.01, range=0..0.02)

# ---- group: SPLIT DATES
branch = TreeBranch(Tree=csv.Values, Path="0", MaintainPaths=True)
panel_2 = Panel(branch)
split = TextSplit(Text=panel_2, Separators="/")  # -> simplify(Result)

# ---- group: CASE COUNT
branch_2 = TreeBranch(Tree=csv.Values, Path="1", MaintainPaths=True)
lng = ListLength(List=branch_2)
multiplication = Multiplication(A=branch_2, B=scaling_multiplier)
series = Series(Start=0, Step=1, Count=lng)
pt = ConstructPoint(XCoordinate=series, YCoordinate=multiplication, ZCoordinate=0)
pt_2 = ConstructPoint(XCoordinate=series, YCoordinate=0, ZCoordinate="0")
ln = Line(StartPoint=pt, EndPoint=pt_2)
case_count_graph = Geometry(ln)
previewlw = CustomPreviewLineweights(
    Geometry=case_count_graph,
    Shader=ColourSwatch(SwatchColor=RGB(71, 0, 0)),
    Thickness=Slider(1, range=0..10),
    Absolute=False)

# ---- group: 7DAY AVG DEATH COUNT
death_count_scale = Slider(0.5, range=0..1)
branch_3 = TreeBranch(Tree=csv.Values, Path="8", MaintainPaths=True)
multiplication_2 = Multiplication(A=branch_3, B=death_count_scale)
pt_3 = ConstructPoint(XCoordinate=series, YCoordinate=multiplication_2, ZCoordinate="2")
pline = PolyLine(Vertices=pt_3, Closed=False)
_7day_avg_deaths_graph = Geometry(pline)
swatch = ColourSwatch(SwatchColor=RGB(255, 68, 0))
previewlw_2 = CustomPreviewLineweights(Geometry=_7day_avg_deaths_graph, Shader=swatch, Thickness=Slider(2, range=0..10), Absolute=False)

# ---- group: 7DAY AVG
branch_4 = TreeBranch(Tree=csv.Values, Path="5", MaintainPaths=True)
multiplication_3 = Multiplication(A=branch_4, B=scaling_multiplier)
pt_4 = ConstructPoint(XCoordinate=series, YCoordinate=multiplication_3, ZCoordinate="1")
pline_2 = PolyLine(Vertices=pt_4, Closed=False)
_7day_avg_graph = Geometry(pline_2)
swatch_2 = ColourSwatch(SwatchColor=RGB(153, 0, 0))
previewlw_3 = CustomPreviewLineweights(Geometry=_7day_avg_graph, Shader=swatch_2, Thickness=Slider(3, range=0..10), Absolute=False)

# ----
date_points = Geometry(pt_2)

# ---- group: TEXT SETTINGS
fonts = FontTable()
number_slider = Slider(10, range=0..10)
text_color = ColourSwatch(SwatchColor=RGB(94, 94, 94))
item = ListItem(List=fonts, Index=Slider(118, range=0..1000), Wrap=True)
panel_3 = Panel(item)

# ---- group: MONTH LABELS
item_2 = ListItem(List=split, Index="0", Wrap=True)  # -> flatten(Item)
shift = ShiftList(List=item_2, Shift="-1", Wrap=True)
equals = Equality(FirstNumber=item_2, SecondNumber=shift)  # -> Equality, Inequality
months = Text(item_2)
mdispatch = DispatchMultiple(DispatchPattern=equals.Inequality, List0=months, List1=date_points)  # -> List0, List1
Y = UnitY(Factor=Slider(10, range=0..100))
move = Move(Geometry=mdispatch.List1, Motion=expr("-x", Y))  # -> Geometry, Transform
justified_text = JustifiedText3d(
    Location=move.Geometry,
    Text=mdispatch.List0,
    Size=number_slider,
    Color=text_color,
    HorizontalAlignment=0,
    VerticalAlginment=2,
    Font=item,
    UseMeshes=False,
    Bake=False)

# ---- group: YEAR LABELS
item_3 = ListItem(List=split, Index="2", Wrap=True)  # -> flatten(Item)
shift_2 = ShiftList(List=item_3, Shift="-1", Wrap=True)
equals_2 = Equality(FirstNumber=item_3, SecondNumber=shift_2)  # -> Equality, Inequality
years = Text(item_3)
mdispatch_2 = DispatchMultiple(DispatchPattern=equals_2.Inequality, List0=years, List1=date_points)  # -> List0, List1
Y_2 = UnitY(Factor=Slider(25, range=0..100))
move_2 = Move(Geometry=mdispatch_2.List1, Motion=expr("-x", Y_2))  # -> Geometry, Transform
justified_text_2 = JustifiedText3d(
    Location=move_2.Geometry,
    Text=mdispatch_2.List0,
    Size=number_slider,
    Color=text_color,
    HorizontalAlignment=0,
    VerticalAlginment=2,
    Font=item,
    UseMeshes=False,
    Bake=False)

# ---- group: HORIZONTAL GRID LINES
length_of_data_set = Number(lng)
pt_5 = ConstructPoint(XCoordinate=0, YCoordinate=0, ZCoordinate="-10")
X = UnitX(Factor=1)
series_2 = Series(Start=0, Step=Slider(25, range=0..100), Count=Slider(25, range=0..100))
line = LineSDL(Start=pt_5, Direction=X, Length=length_of_data_set)
Y_3 = UnitY(Factor=series_2)
move_3 = Move(Geometry=line, Motion=Y_3)  # -> Geometry, Transform
end = EndPoints(Curve=move_3.Geometry)  # -> Start, End
previewlw_4 = CustomPreviewLineweights(Geometry=move_3.Geometry, Shader=ColourSwatch(SwatchColor=RGB(0, 0, 76)), Absolute=False)

# ---- group: VERTICAL GRID LINES
y_values = Number(series_2)
item_4 = ListItem(List=y_values, Index="-1", Wrap=True)
month_points = Geometry(mdispatch.List1)
Y_4 = UnitY(Factor=1)
line_2 = LineSDL(Start=month_points, Direction=Y_4, Length=item_4)
previewlw_5 = CustomPreviewLineweights(Geometry=line_2, Shader=ColourSwatch(SwatchColor=RGB(0, 0, 64)), Absolute=False)

# ---- group: CASE COUNT LABELS
case_count_scale_factor = Number(scaling_multiplier)
X_2 = UnitX(Factor=expr("-x", Slider(5, range=0..10)))
division = Division(A=series_2, B=case_count_scale_factor)
move_4 = Move(Geometry=end.Start, Motion=X_2)  # -> Geometry, Transform
justified_text_3 = JustifiedText3d(
    Location=move_4.Geometry,
    Text=division,
    Size=number_slider,
    Color=swatch_2,
    HorizontalAlignment=2,
    VerticalAlginment=1,
    Font=item,
    UseMeshes=False,
    Bake=False)

# ---- group: DEATH COUNT LABELS
death_count_scale_factor = Number(death_count_scale)
X_3 = UnitX(Factor=Slider(5, range=0..10))
move_5 = Move(Geometry=end.End, Motion=X_3)  # -> Geometry, Transform
division_2 = Division(A=series_2, B=death_count_scale_factor)
justified_text_4 = JustifiedText3d(
    Location=move_5.Geometry,
    Text=division_2,
    Size=number_slider,
    Color=swatch,
    HorizontalAlignment=0,
    VerticalAlginment=1,
    Font=item,
    UseMeshes=False,
    Bake=False)

# ---- group: SELECT DATE
length_of_data_set_2 = Number(lng)
subtraction = Subtraction(A=length_of_data_set_2, B="1")
multiplication_4 = Multiplication(A=subtraction, B=Slider(1, range=0..1))
round = Round(Number=multiplication_4)  # -> Nearest, Floor, Ceiling
current_date_index = Number(round.Nearest)

# ----
current_date_index_2 = Number(round.Nearest)
date_points_2 = Geometry(pt_2)
item_5 = ListItem(List=date_points_2, Index=current_date_index_2, Wrap=True)
current_date_point = Point(item_5)

# ---- group: DATE MARKER LINE
graph_height = Number(item_4)
Y_5 = UnitY(Factor=1)
line_3 = LineSDL(Start=current_date_point, Direction=Y_5, Length=graph_height)
previewlw_6 = CustomPreviewLineweights(Geometry=line_3, Shader=ColourSwatch(SwatchColor=RGB(0, 0, 128)), Thickness=Slider(5, range=0..10), Absolute=False)

# ---- group: FILLED DEATH COUNT AREA
death_count_graph_points = Geometry(pt_3)
dom = ConstructDomain(DomainStart=0, DomainEnd=current_date_index)
subset = SubList(List=death_count_graph_points, Domain=dom, Wrap=True)  # -> List, Index
current_date_point_2 = Point(current_date_point)
merge = Merge(Data1=flatten(subset.List), Data2=flatten(current_date_point_2))
pdecon = Deconstruct(Point=merge)  # -> XComponent, YComponent, ZComponent
pt_6 = ConstructPoint(XCoordinate=pdecon.XComponent, YCoordinate=pdecon.YComponent, ZCoordinate="2")
pline_3 = PolyLine(Vertices=pt_6, Closed=True)
boundary = BoundarySurfaces(Edges=pline_3)
death_graph_color = Colour(swatch)
previewmat = CustomPreviewMaterials(Geometry=boundary, DiffuseColor=death_graph_color, Transparency=Slider(0.75, range=0..1))

# ----
vertical_grid_lines = Geometry(line_2)
item_6 = ListItem(List=vertical_grid_lines, Index=0, Wrap=True)
end_2 = EndPoints(Curve=item_6)  # -> Start, End
grid_top_left_corner = Geometry(end_2.End)
vec = VectorXYZ(XComponent=Slider(10, range=0..100), YComponent=expr("-x", Slider(10, range=0..100)), ZComponent="10")  # -> Vector, Length
Y_6 = UnitY(Factor=expr("-x", Slider(36, range=0..100)))
move_6 = Move(Geometry=grid_top_left_corner, Motion=vec.Vector)  # -> Geometry, Transform
move_7 = Move(Geometry=move_6.Geometry, Motion=Y_6)  # -> Geometry, Transform
move_8 = Move(Geometry=move_7.Geometry, Motion=Y_6)  # -> Geometry, Transform
death_total_location = Geometry(move_8.Geometry)
case_total_location = Geometry(move_7.Geometry)
date_location = Geometry(move_6.Geometry)

current_date_point_3 = Point(current_date_point)

# ---- group: FILLED CASE COUNT AREA
case_count_graph_ponts = Geometry(pt_4)
dom_2 = ConstructDomain(DomainStart=0, DomainEnd=current_date_index)
subset_2 = SubList(List=case_count_graph_ponts, Domain=dom_2, Wrap=True)  # -> List, Index
merge_2 = Merge(Data1=flatten(subset_2.List), Data2=flatten(current_date_point_3))
pdecon_2 = Deconstruct(Point=merge_2)  # -> XComponent, YComponent, ZComponent
pt_7 = ConstructPoint(XCoordinate=pdecon_2.XComponent, YCoordinate=pdecon_2.YComponent, ZCoordinate="1")
pline_4 = PolyLine(Vertices=pt_7, Closed=True)
boundary_2 = BoundarySurfaces(Edges=pline_4)
case_graph_color = Colour(swatch_2)
previewmat_2 = CustomPreviewMaterials(Geometry=boundary_2, DiffuseColor=case_graph_color)

# ----
current_date_index_3 = Number(current_date_index)

case_counts = Number(branch_2)
ma = MassAddition(Input=case_counts)  # -> Result, PartialResults
item_7 = ListItem(List=ma.PartialResults, Index=current_date_index_3, Wrap=True)
current_case_total = Integer(item_7)
merge_3 = Merge(Data1=flatten("Total Cases: "), Data2=flatten(current_case_total))
join = TextJoin(Text=merge_3)
case_total_location_2 = Geometry(case_total_location)
case_graph_color_2 = Colour(swatch_2)
justified_text_5 = JustifiedText3d(
    Location=case_total_location_2,
    Text=join,
    Size="20",
    Color=case_graph_color_2,
    HorizontalAlignment=0,
    VerticalAlginment=1,
    Font=item,
    UseMeshes=False,
    Bake=False)

death_counts = Number(branch_3)
ma_2 = MassAddition(Input=death_counts)  # -> Result, PartialResults
item_8 = ListItem(List=ma_2.PartialResults, Index=current_date_index_3, Wrap=True)
current_death_total = Number(item_8)
merge_4 = Merge(Data1=flatten("Total Deaths: "), Data2=flatten(current_death_total))
join_2 = TextJoin(Text=merge_4)
death_graph_color_2 = Colour(swatch)
death_total_location_2 = Geometry(death_total_location)
justified_text_6 = JustifiedText3d(
    Location=death_total_location_2,
    Text=join_2,
    Size="20",
    Color=death_graph_color_2,
    HorizontalAlignment=0,
    VerticalAlginment=1,
    Font=item,
    UseMeshes=False,
    Bake=False)

# ---- group: DATE LABEL
dates = Text(panel_2)
item_9 = ListItem(List=dates, Index=current_date_index_3, Wrap=True)
date_location_2 = Geometry(date_location)
current_date = Text(item_9)
date_color = Colour(text_color)
justified_text_7 = JustifiedText3d(
    Location=date_location_2,
    Text=current_date,
    Size="20",
    Color=date_color,
    HorizontalAlignment=0,
    VerticalAlginment=1,
    Font=item,
    UseMeshes=False,
    Bake=False)
