# Grasshopper definition smorgasbord data viz tests.gh (Grasshopper 1.0.7)
# plug-ins: LunchBox, Human

path = FilePath("D:\GitHub\Smorgasbord\src\content\modules\21-data-representation-with-grasshopper\assets\COVID-19_Daily_Counts_of_Cases__Hospitalizations__and_Deaths.csv")
file = ReadFile(File=path, PerLineParse=True)
scaling_factor = Slider(0.02, range=0..1)
csv = ReadCSV(CSVString=file, Delimiter=",")  # -> Headers, Values

branch = TreeBranch(Tree=csv.Values, Path="1", MaintainPaths=True)
case_count = Number(branch)
lng = ListLength(List=case_count)
multiplication = Multiplication(A=case_count, B=scaling_factor)
series = Series(Start=0, Step=1, Count=lng)
pt = ConstructPoint(XCoordinate=series, YCoordinate=multiplication, ZCoordinate="-1")
pt_2 = ConstructPoint(XCoordinate=series, YCoordinate="0", ZCoordinate="-1")
ln = Line(StartPoint=pt, EndPoint=pt_2)
previewlw = CustomPreviewLineweights(Geometry=ln, Shader=ColourSwatch(SwatchColor=RGB(46, 46, 46)), Thickness=Slider(1, range=0..10), Absolute=False)

# ---- group: CASE COUNT 7 DAY AVG
branch_2 = TreeBranch(Tree=csv.Values, Path="5", MaintainPaths=True)
case_count_7_day_avg = Number(branch_2)
multiplication_2 = Multiplication(A=case_count_7_day_avg, B=scaling_factor)
pt_3 = ConstructPoint(XCoordinate=series, YCoordinate=multiplication_2, ZCoordinate=0)
pline = PolyLine(Vertices=pt_3, Closed=False)
previewlw_2 = CustomPreviewLineweights(Geometry=pline, Shader=ColourSwatch(SwatchColor=RGB(255, 255, 255)), Thickness=Slider(3, range=0..10), Absolute=False)

# ---- group: DEATH COUNT
branch_3 = TreeBranch(Tree=csv.Values, Path="8", MaintainPaths=True)
death_count_7_day_avg = Number(branch_3)
multiplication_3 = Multiplication(A=death_count_7_day_avg, B=Slider(1, range=0..1))
pt_4 = ConstructPoint(XCoordinate=series, YCoordinate=multiplication_3, ZCoordinate=0)
pline_2 = PolyLine(Vertices=pt_4, Closed=False)
previewlw_3 = CustomPreviewLineweights(Geometry=pline_2, Shader=ColourSwatch(SwatchColor=RGB(255, 0, 0)), Thickness=Slider(1, range=0..10), Absolute=False)

# ----
panel = Panel(csv.Headers)
