# Grasshopper definition smorgasbord media tests audio.gh (Grasshopper 1.0.7)
# plug-ins: MosquitoAudio2, Firefly.Core, Human, Firefly.X

# ---- group: FIREFLY FREQUENCY SPECTRUM
spectrum = FrequencySpectrum()  # -> NoteVolume, PeakFrequency, PeakNote

# ---- group: IMPORT AUDIO
number_slider = Slider(500, range=0..1000)  # disabled
daft_punk = FilePath("D:\GitHub\Smorgasbord\src\content\modules\21-parametric-visualization-with-grasshopper\assets\04 Harder, Better, Faster, Stronger.MP3")  # disabled
audiowave = AudioWave(AudioFile=daft_punk, Skip=number_slider)  # -> Peak, Points, Length; disabled

# ---- group: FIREFLY FREQUENCY SPECTRUM
spectrum_2 = FrequencySpectrum()  # -> NoteVolume, PeakFrequency, PeakNote; disabled

# ---- group: SCALE VERTICALLY
number_slider_2 = Slider(50, range=0..100)  # disabled
pdecon = Deconstruct(Point=audiowave.Points)  # -> XComponent, YComponent, ZComponent; disabled
multiplication = Multiplication(A=pdecon.ZComponent, B=number_slider_2)  # disabled

# ---- group: REMOVE UPPER HALF OF SPECTRUM
lng = ListLength(List=spectrum.NoteVolume)
multiplication_2 = Multiplication(A=lng, B=Slider(0.5, range=0..1))
subset = SubList(List=spectrum.NoteVolume, Domain=multiplication_2, Wrap=True)  # -> List, Index

# ---- group: SMOOTH DATA
number_slider_3 = Slider(250, range=0..1000)  # disabled
abs = Absolute(Value=multiplication)  # disabled
smooth = SmoothingMovingAverage(Number=abs, Samples=number_slider_3)  # -> flatten(SmoothedAverage); disabled
smooth_2 = SmoothingMovingAverage(Number=smooth, Samples=number_slider_3)  # -> flatten(SmoothedAverage); disabled

# ---- group: REMOVE UPPER HALF OF SPECTRUM
number_slider_4 = Slider(0.5, range=0..1)  # disabled
lng_2 = ListLength(List=spectrum_2.NoteVolume)  # disabled
multiplication_3 = Multiplication(A=lng_2, B=number_slider_4)  # disabled
subset_2 = SubList(List=spectrum_2.NoteVolume, Domain=multiplication_3, Wrap=True)  # -> List, Index; disabled

# ---- group: FIREFLY FREQUENCY SPECTRUM
spectrum_3 = FrequencySpectrum()  # -> NoteVolume, PeakFrequency, PeakNote; disabled

# ---- group: CREATE POLYLINE
series = Series(Start=0, Step=1, Count=multiplication_2)
multiplication_4 = Multiplication(A=subset.List, B=Slider(3000, range=0..10000))
pt = ConstructPoint(XCoordinate=series, YCoordinate=0, ZCoordinate=multiplication_4)  # -> simplify(Point)
pline = PolyLine(Vertices=pt, Closed=False)

# ----
pt_2 = ConstructPoint(XCoordinate=pdecon.XComponent, YCoordinate=0, ZCoordinate=smooth_2)  # disabled

# ---- group: VERTICAL FILL LINES
panel = Panel("1")  # disabled
pt_3 = ConstructPoint(XCoordinate=pdecon.XComponent, YCoordinate=panel, ZCoordinate=0)  # disabled
swatch = ColourSwatch(SwatchColor=RGB(0, 49, 112))  # disabled
ln = Line(StartPoint=pt_3, EndPoint=pt_2)  # disabled
previewlw = CustomPreviewLineweights(Geometry=ln, Shader=swatch, Absolute=False)  # disabled

# ---- group: TOP LINE
number_slider_5 = Slider(2, range=0..10)  # disabled
swatch_2 = ColourSwatch(SwatchColor=RGB(133, 153, 255))  # disabled
pline_2 = PolyLine(Vertices=pt_2, Closed=False)  # disabled
previewlw_2 = CustomPreviewLineweights(Geometry=pline_2, Shader=swatch_2, Thickness=number_slider_5, Absolute=False)  # disabled

# ---- group: CREATE POLYLINE
number_slider_6 = Slider(3000, range=0..10000)  # disabled
series_2 = Series(Start=0, Step=1, Count=multiplication_3)  # disabled
multiplication_5 = Multiplication(A=subset_2.List, B=number_slider_6)  # disabled
pt_4 = ConstructPoint(XCoordinate=series_2, YCoordinate=0, ZCoordinate=multiplication_5)  # -> simplify(Point); disabled
pline_3 = PolyLine(Vertices=pt_4, Closed=False)  # disabled

# ----
number_slider_7 = Slider(3000, range=0..10000)  # disabled
lng_3 = ListLength(List=spectrum_3.NoteVolume)  # disabled
series_3 = Series(Start=0, Step=1, Count=lng_3)  # disabled
multiplication_6 = Multiplication(A=spectrum_3.NoteVolume, B=number_slider_7)  # disabled

# ---- group: RECORD DATA
rec = DataRecorder(pline, DataLimit=-10, RecordData=False)

# ----
pt_5 = ConstructPoint(XCoordinate=series_3, YCoordinate=0, ZCoordinate=multiplication_6)  # -> simplify(Point); disabled

# ---- group: USE ONLY X MOST RECENT
number_slider_8 = Slider(128, range=0..1000)
rev = ReverseList(List=rec)
subset_3 = SubList(List=rev, Domain=number_slider_8, Wrap=True)  # -> List, Index

# ---- group: RECORD DATA
rec_2 = DataRecorder(pline_3, DataLimit=-10, RecordData=False)  # disabled

# ----
pline_4 = PolyLine(Vertices=pt_5, Closed=False)  # disabled

# ---- group: MOVE POLYLINES
rev_2 = ReverseList(List=rec_2)  # disabled
lng_4 = ListLength(List=rev_2)  # disabled
series_4 = Series(Start=0, Step=1, Count=lng_4)  # disabled
Y = UnitY(Factor=series_4)  # disabled
move = Move(Geometry=rev_2, Motion=Y)  # -> Geometry, Transform; disabled

# ---- group: CREATE COLORS
num = Number(number_slider_8)
series_5 = Series(Start=0, Step=1, Count=num)  # -> reverse(Series)
gradient = Gradient(
    LowerLimit=0,
    UpperLimit=num,
    Parameter=series_5,
    stops=[0: RGB(234, 38, 0), 0.25: RGB(234, 126, 0), 0.5: RGB(254, 244, 84), 0.75: RGB(173, 203, 249), 1: RGB(75, 107, 169)])

# ---- group: MOVE POLYLINES
series_6 = Series(Start=0, Step=Slider(0.5, range=0..1), Count=number_slider_8)
Y_2 = UnitY(Factor=series_6)
move_2 = Move(Geometry=subset_3.List, Motion=Y_2)  # -> Geometry, Transform

# ---- group: FRONT LINE
item = ListItem(List=subset_3.List, Index=0, Wrap=True)
Y_3 = UnitY(Factor="-1")
move_3 = Move(Geometry=item, Motion=Y_3)  # -> Geometry, Transform
previewlw_3 = CustomPreviewLineweights(
    Geometry=move_3.Geometry,
    Shader=ColourSwatch(SwatchColor=RGB(255, 255, 255)),
    Thickness=Slider(5, range=0..100),
    Absolute=False)

# ----
previewlw_4 = CustomPreviewLineweights(Geometry=move_2.Geometry, Shader=gradient, Thickness=Slider(15, range=0..100), Absolute=False)
