# Grasshopper definition smorgasbord media tests.gh (Grasshopper 1.0.7)
# plug-ins: Human, Firefly.Core

number_slider = Slider(64, range=0..100)  # disabled
path = FilePath("D:\GitHub\Smorgasbord\src\content\modules\21-parametric-visualization-with-grasshopper\assets\sherman\sherman-cindy_untitled-70_1980.jpg")  # disabled

# ---- group: CREATE IMAGE MESH
number_slider_2 = Slider(64, range=0..100)  # disabled
path_2 = FilePath("D:\GitHub\Smorgasbord\src\content\modules\21-parametric-visualization-with-grasshopper\assets\sherman\sherman-cindy_untitled-70_1980.jpg")  # disabled
img = ImportImage(File=path_2, XSamples=number_slider_2, YSamples=number_slider_2)  # disabled
demesh = DeconstructMesh(Mesh=img)  # -> Vertices, Faces, Colours, Normals; disabled

number_slider_3 = Slider(64, range=0..100)
path_3 = FilePath("D:\GitHub\Smorgasbord\src\content\modules\21-parametric-visualization-with-grasshopper\assets\sherman\sherman-cindy_SCAN002-2020.jpg")
img_2 = ImportImage(File=path_3, XSamples=number_slider_3, YSamples=number_slider_3)
demesh_2 = DeconstructMesh(Mesh=img_2)  # -> Vertices, Faces, Colours, Normals

# ----
img_3 = ImportImage(File=path, XSamples=number_slider, YSamples=number_slider)  # disabled
number_slider_4 = Slider(1000, range=0..1000)  # disabled
demesh_3 = DeconstructMesh(Mesh=img_3)  # -> Vertices, Faces, Colours, Normals; disabled

# ---- group: CREATE LINES
number_slider_5 = Slider(1000, range=0..1000)  # disabled
X = UnitX(Factor=1)  # disabled
pt = Point(<point referenced from the Rhino model>)  # disabled
number_slider_6 = Slider(200, range=0..1000)  # disabled
lng = ListLength(List=demesh.Colours)  # disabled
line = LineSDL(Start=pt, Direction=X, Length=number_slider_5)  # disabled
Y = UnitY(Factor=1)  # disabled
divide = DivideCurve(Curve=line, Count=lng, Kinks=False)  # -> Points, Tangents, Parameters; disabled
line_2 = LineSDL(Start=divide.Points, Direction=Y, Length=number_slider_6)  # disabled

# ----
X_2 = UnitX(Factor=1)  # disabled
pt_2 = Point(<point referenced from the Rhino model>)  # disabled
number_slider_7 = Slider(64, range=0..1000)
lng_2 = ListLength(List=demesh_3.Colours)  # disabled
barbz = FilePath("D:\GitHub\Smorgasbord\src\content\modules\21-parametric-visualization-with-grasshopper\assets\sherman\sherman-cindy_untitled-70_1980.jpg")
barbz_2 = FilePath("D:\GitHub\Smorgasbord\src\content\modules\21-parametric-visualization-with-grasshopper\assets\16BARBIE-CONVO-wjhq-mediumSquareAt3X.jpg")
barbz_3 = FilePath("C:\Users\zacha\Desktop\IMG_9453.jpeg")
line_3 = LineSDL(Start=pt_2, Direction=X_2, Length=number_slider_4)  # disabled
number_slider_8 = Slider(606, range=0..1000)  # disabled
divide_2 = DivideCurve(Curve=line_3, Count=lng_2, Kinks=False)  # -> Points, Tangents, Parameters; disabled
Y_2 = UnitY(Factor=1)  # disabled
img_4 = ImportImage(File=barbz, XSamples=number_slider_7, YSamples=number_slider_7)

# ---- group: SORT BY HUE
ahsv = SplitAHSV(Colour=demesh_2.Colours)  # -> Alpha, Hue, Saturation, Value
sort = SortList(Keys=ahsv.Hue, ValuesA=ahsv.Saturation, ValuesB=ahsv.Value)  # -> Keys, ValuesA, ValuesB

# ---- group: DUPLICATE LINES
number_slider_9 = Slider(211, range=0..1000)  # disabled
Y_3 = UnitY(Factor=number_slider_9)  # disabled
move = Move(Geometry=line_2, Motion=expr("x*2", Y_3))  # -> Geometry, Transform; disabled
move_2 = Move(Geometry=line_2, Motion=Y_3)  # -> Geometry, Transform; disabled

# ---- group: SORT BY HSV
ahsv_2 = SplitAHSV(Colour=demesh.Colours)  # -> Alpha, Hue, Saturation, Value; disabled
sort_2 = SortList(Keys=ahsv_2.Saturation, ValuesA=demesh.Colours)  # -> Keys, ValuesA; disabled
sort_3 = SortList(Keys=ahsv_2.Hue, ValuesA=demesh.Colours)  # -> Keys, ValuesA; disabled
sort_4 = SortList(Keys=ahsv_2.Value, ValuesA=demesh.Colours)  # -> Keys, ValuesA; disabled

# ----
demesh_4 = DeconstructMesh(Mesh=img_4)  # -> Vertices, Faces, Colours, Normals
number_slider_10 = Slider(500, range=0..1000)  # disabled
line_4 = LineSDL(Start=divide_2.Points, Direction=Y_2, Length=number_slider_8)  # disabled

# ---- group: AVERAGE S&V
addition = Addition(A=sort.ValuesA, B=sort.ValuesB)
division = Division(A=addition, B="2")

# ----
previewlw = CustomPreviewLineweights(Geometry=line_4, Shader=demesh_3.Colours, Absolute=False)  # disabled
ahsv_3 = SplitAHSV(Colour=demesh_4.Colours)  # -> Alpha, Hue, Saturation, Value

previewlw_2 = CustomPreviewLineweights(Geometry=line_2, Shader=sort_3.ValuesA, Absolute=False)  # disabled
previewlw_3 = CustomPreviewLineweights(Geometry=move_2.Geometry, Shader=sort_2.ValuesA, Absolute=False)  # disabled
previewlw_4 = CustomPreviewLineweights(Geometry=move.Geometry, Shader=sort_4.ValuesA, Absolute=False)  # disabled

addition_2 = Addition(A=ahsv_3.Saturation, B=ahsv_3.Value)
cir = Circle(Plane="0,0,0", Radius=1)
lng_3 = ListLength(List=demesh_4.Colours)
division_2 = Division(A=addition_2, B="2")
hsv = ColourHSV(Alpha=1, Hue=sort.Keys, Saturation=1, Value=1)
hsv_2 = ColourHSV(Alpha=1, Hue=ahsv_3.Hue, Saturation=1, Value=1)
divide_3 = DivideCurve(Curve=cir, Count=lng_3, Kinks=False)  # -> Points, Tangents, Parameters
sort_5 = SortList(Keys=ahsv_3.Hue, ValuesA=division_2)  # -> Keys, ValuesA
sort_6 = SortList(Keys=ahsv_3.Hue, ValuesA=hsv_2)  # -> Keys, ValuesA
vec2pt = Vector2Pt(PointA="0,0,0", PointB=divide_3.Points, Unitize=True)  # -> Vector, Length
multiplication = Multiplication(A=Slider(1000, range=0..1000), B=sort_5.ValuesA)
smooth = SmoothingMovingAverage(Number=multiplication, Samples=Slider(36, range=0..1000))
line_5 = LineSDL(Start="0,0,0", Direction=vec2pt.Vector, Length=smooth)
previewlw_5 = CustomPreviewLineweights(Geometry=line_5, Shader=sort_6.ValuesA, Absolute=False)

# ---- group: DRAW LINES
pt_3 = Point(<point referenced from the Rhino model>)
lng_4 = ListLength(List=demesh_2.Colours)
cir_2 = Circle(Plane=pt_3, Radius=1)
divide_4 = DivideCurve(Curve=cir_2, Count=lng_4, Kinks=False)  # -> Points, Tangents, Parameters
vec2pt_2 = Vector2Pt(PointA=pt_3, PointB=divide_4.Points, Unitize=True)  # -> Vector, Length
multiplication_2 = Multiplication(A=Slider(500, range=0..1000), B=division)

# ----
smooth_2 = SmoothingMovingAverage(Number=multiplication_2, Samples=Slider(48, range=0..100))
cir_3 = Circle(Plane=pt_3, Radius=number_slider_10)  # disabled

# ---- group: DRAW LINES (continued)
line_6 = LineSDL(Start=divide_4.Points, Direction=vec2pt_2.Vector, Length=smooth_2)

# ----
previewlw_6 = CustomPreviewLineweights(Geometry=line_6, Shader=hsv, Absolute=False)
