# Grasshopper definition simple_box.gh (Grasshopper 1.0.7)

pt = ConstructPoint(XCoordinate=0, YCoordinate=0, ZCoordinate="1")
Z = UnitZ(Factor="1")
neg = Negative(Value=Z)
line = LineSDL(Start=pt, Direction=neg, Length=1)
Y = UnitY(Factor=1)
amp = Amplitude(Vector=Y, Amplitude="1")
extr = Extrude(Base=line, Direction=amp)
X = UnitX(Factor="1")
extr_2 = Extrude(Base=extr, Direction=X)
