# Grasshopper definition subdivision_mass_customization.gh (Grasshopper 1.0.7)
# plug-ins: LunchBox

srf_host_surface = Surface(<surface referenced from the Rhino model>)
deviation_threshold = Slider(0.065, range=0..0.3)

srf_host_surface_2 = Surface(srf_host_surface)
num_panel_height = Number(Slider(7, range=0..12))
num_panel_width = Number(Slider(16, range=0..20))
dim = Dimensions(Surface=srf_host_surface_2)  # -> UDimension, VDimension
srf_host_surface_3 = Surface(srf_host_surface_2)
division = Division(A=dim.UDimension, B=num_panel_height)
division_2 = Division(A=dim.VDimension, B=num_panel_width)
divide = DivideDomain²(Domain=srf_host_surface_3, UCount=division, VCount=division_2)
subsrf = Isotrim(Surface=srf_host_surface_3, Domain=divide)

srf_subdivided_surfaces = Surface(subsrf)

srf_subdivided_surfaces_2 = Surface(srf_subdivided_surfaces)
srf_subdivided_surfaces_3 = Surface(srf_subdivided_surfaces_2)
flat = FlatnessCheck(PanelList=srf_subdivided_surfaces_2)  # -> FlatPanels, Planes, Deviations
num_srf_deviation = Number(flat.Deviations)
bnd = Bounds(Numbers=num_srf_deviation)
dedomain = DeconstructDomain(Domain=bnd)  # -> Start, End
gradient = Gradient(
    LowerLimit=dedomain.End,
    UpperLimit=dedomain.Start,
    Parameter=num_srf_deviation,
    stops=[0: RGB(234, 38, 0), 0.25: RGB(234, 126, 0), 0.5: RGB(254, 244, 84), 0.75: RGB(173, 203, 249), 1: RGB(75, 107, 169)])
preview = CustomPreview(Geometry=srf_subdivided_surfaces_3, Material=gradient)

larger = LargerThan(FirstNumber=flat.Deviations, SecondNumber=deviation_threshold)  # -> LargerThan, OrEqualTo
srf_flattened_panels = Surface(flat.FlatPanels)
dispatch = Dispatch(List=srf_subdivided_surfaces_2, DispatchPattern=larger.LargerThan)  # -> ListA, ListB
dispatch_2 = Dispatch(List=srf_flattened_panels, DispatchPattern=larger.LargerThan)  # -> ListA, ListB
srf_curved_for_triangulation = Surface(dispatch.ListA)
srf_flat_below_threshold = Surface(dispatch_2.ListB)
debrep = DeconstructBrep(Brep=srf_curved_for_triangulation)  # -> Faces, Edges, Vertices
pt_panel_points = Point(debrep.Vertices)
item = ListItem(List=pt_panel_points, Index=0, Wrap=True)  # -> Item, Item1, Item2, Item3
order = PointOrder(Points=pt_panel_points)
point = Point(item.Item3)
point_2 = Point(item.Item)
point_3 = Point(item.Item1)
point_4 = Point(item.Item2)
merge = Merge(Data1=point_2, Data2=point_3, Data3=point)
merge_2 = Merge(Data1=point_3, Data2=point_4, Data3=point)
toggle = BooleanToggle(True)
pline = PolyLine(Vertices=merge, Closed=toggle)
pline_2 = PolyLine(Vertices=merge_2, Closed=toggle)

crv_triangle_1 = Curve(pline)
crv_triangle_2 = Curve(pline_2)
srf_flat_below_threshold_2 = Surface(srf_flat_below_threshold)
graft = GraftTree(Tree=srf_flat_below_threshold_2, IncludeEmptyLists=True, IncludeNullItems=True)

md_slider = MDSlider(SliderMode=0, slider_value=Point(0.5, 0.5, 0.5), x_domain=Domain(0, 1), y_domain=Domain(0, 1), z_domain=Domain(0, 1))
graft_2 = GraftTree(Tree=srf_flat_below_threshold_2, IncludeEmptyLists=True, IncludeNullItems=True)
evalsrf = EvaluateSurface(Surface=reparameterize(crv_triangle_1), Point=md_slider)  # -> Point, Normal, UDirection, VDirection, Frame
evalsrf_2 = EvaluateSurface(Surface=reparameterize(crv_triangle_2), Point=md_slider)  # -> Point, Normal, UDirection, VDirection, Frame
evalsrf_3 = EvaluateSurface(Surface=reparameterize(graft_2), Point=md_slider)  # -> Point, Normal, UDirection, VDirection, Frame
line = LineSDL(Start=evalsrf.Point, Direction=evalsrf.Normal, Length="10")
line_2 = LineSDL(Start=evalsrf_2.Point, Direction=evalsrf_2.Normal, Length="10")
line_3 = LineSDL(Start=evalsrf_3.Point, Direction=evalsrf_3.Normal, Length="10")
Z = UnitZ(Factor=1)
Z_2 = UnitZ(Factor=1)
Z_3 = UnitZ(Factor=1)
line_4 = LineSDL(Start=evalsrf.Point, Direction=Z_3, Length="10")
line_5 = LineSDL(Start=evalsrf_2.Point, Direction=Z, Length="10")
line_6 = LineSDL(Start=evalsrf_3.Point, Direction=Z_2, Length="10")
lnln = LineLine(LineA=line_4, LineB=line)
lnln_2 = LineLine(LineA=line_5, LineB=line_2)
lnln_3 = LineLine(LineA=line_6, LineB=line_3)
angle = Angle(VectorA=line_4, VectorB=line, Plane=lnln)  # -> Angle, Reflex
angle_2 = Angle(VectorA=line_5, VectorB=line_2, Plane=lnln_2)  # -> Angle, Reflex
angle_3 = Angle(VectorA=line_6, VectorB=line_3, Plane=lnln_3)  # -> Angle, Reflex
panel = Panel(angle.Angle)
panel_2 = Panel(angle_2.Angle)
panel_3 = Panel(angle_3.Angle)

num_triangle_angle_1 = Number(angle.Angle)
num_triangle_angle_2 = Number(angle_2.Angle)
num_4_sided_angle_2 = Number(angle_3.Angle)

num_triangle_angle_2_2 = Number(num_triangle_angle_2)
num_triangle_angle_1_2 = Number(num_triangle_angle_1)
num_4_sided_angle_2_2 = Number(num_4_sided_angle_2)
crv_triangle_1_2 = Curve(crv_triangle_1)
crv_triangle_2_2 = Curve(crv_triangle_2)
srf_flat_below_threshold_3 = Surface(graft)
md_slider_2 = MDSlider(SliderMode=0, slider_value=Point(0.5, 0.5, 0.5), x_domain=Domain(0, 1), y_domain=Domain(0, 1), z_domain=Domain(0, 1))
entwine = Entwine(Branch0X=num_triangle_angle_1_2, Branch1X=num_triangle_angle_2_2, Branch2X=num_4_sided_angle_2_2, FlattenInputs=False)  # -> simplify(Result)
entwine_2 = Entwine(Branch0X=crv_triangle_1_2, Branch1X=crv_triangle_2_2, Branch2X=srf_flat_below_threshold_3, FlattenInputs=False)  # -> simplify(Result)
flatten = FlattenTree(Tree=entwine, Path="{0}")
bnd_2 = Bounds(Numbers=flatten)
evalsrf_4 = EvaluateSurface(Surface=entwine_2, Point=md_slider_2)  # -> Point, Normal, UDirection, VDirection, Frame
dom = ConstructDomain(DomainStart=Slider(2.44, range=0..5), DomainEnd=Slider(0.15, range=0..5))
remap = RemapNumbers(Value=entwine, Source=bnd_2, Target=dom)  # -> Mapped, Clipped
neg = Negative(Value=remap.Mapped)
offset = OffsetCurve(Curve=entwine_2, Distance=neg, Plane=evalsrf_4.Frame, Corners=1)  # -> simplify(Curve)
merge_3 = Merge(Data1=offset, Data2=entwine_2)
loft = Loft(Curves=merge_3, Options={Adjust=False, Closed=False, LoftEnds=0, LoftSimp=0, LoftType=0, Rebuild=10, Refit=0.01})

brep_panels = Brep(loft)
