# Grasshopper definition subdivision_planarity_analysis.gh (Grasshopper 1.0.7)
# plug-ins: LunchBox

srf_host_surface = Surface(<surface referenced from the Rhino model>)

srf_host_surface_2 = Surface(srf_host_surface)
num_panel_height = Number(Slider(7, range=0..12))
num_panel_width = Number(Slider(16, range=0..20))
dim = Dimensions(Surface=srf_host_surface_2)  # -> UDimension, VDimension
srf_host_surface_3 = Surface(srf_host_surface_2)
division = Division(A=dim.UDimension, B=num_panel_height)
division_2 = Division(A=dim.VDimension, B=num_panel_width)
divide = DivideDomain²(Domain=srf_host_surface_3, UCount=division, VCount=division_2)
subsrf = Isotrim(Surface=srf_host_surface_3, Domain=divide)

srf_subdivided_surfaces = Surface(subsrf)

srf_subdivided_surfaces_2 = Surface(srf_subdivided_surfaces)
srf_subdivided_surfaces_3 = Surface(srf_subdivided_surfaces_2)
flat = FlatnessCheck(PanelList=srf_subdivided_surfaces_2)  # -> FlatPanels, Planes, Deviations
num_srf_deviation = Number(flat.Deviations)
bnd = Bounds(Numbers=num_srf_deviation)
dedomain = DeconstructDomain(Domain=bnd)  # -> Start, End
gradient = Gradient(
    LowerLimit=dedomain.End,
    UpperLimit=dedomain.Start,
    Parameter=num_srf_deviation,
    stops=[0: RGB(234, 38, 0), 0.25: RGB(234, 126, 0), 0.5: RGB(254, 244, 84), 0.75: RGB(173, 203, 249), 1: RGB(75, 107, 169)])
preview = CustomPreview(Geometry=srf_subdivided_surfaces_3, Material=gradient)
