# Grasshopper definition surface_subdivision.gh (Grasshopper 1.0.7)

srf_host_surface = Surface(<surface referenced from the Rhino model>)

srf_host_surface_2 = Surface(srf_host_surface)
num_panel_height = Number(Slider(8, range=0..12))
num_panel_width = Number(Slider(11, range=0..20))
dim = Dimensions(Surface=srf_host_surface_2)  # -> UDimension, VDimension
srf_host_surface_3 = Surface(srf_host_surface_2)
division = Division(A=dim.UDimension, B=num_panel_height)
division_2 = Division(A=dim.VDimension, B=num_panel_width)
divide = DivideDomain²(Domain=srf_host_surface_3, UCount=division, VCount=division_2)
subsrf = Isotrim(Surface=srf_host_surface_3, Domain=divide)

srf_subdivided_surfaces = Surface(subsrf)
srf_subdivided_surfaces_2 = Surface(srf_subdivided_surfaces)
