# Grasshopper definition establishing_key_1.gh (Grasshopper 1.0.8)
# plug-ins: LunchBox

pipeline = GeometryPipeline(
    GroupByLayer=False,
    GroupByType=False,
    IncludeHidden=True,
    IncludeLocked=True,
    LayerFilter="*CON_ZONING_ENVELOPE_1",
    NameFilter="*",
    SublayerFiltering=True,
    TypeFilter=1073741848)
pipeline_2 = GeometryPipeline(
    GroupByLayer=False,
    GroupByType=False,
    IncludeHidden=True,
    IncludeLocked=True,
    LayerFilter="*CON_ZONING_ENVELOPE_2",
    NameFilter="*",
    SublayerFiltering=True,
    TypeFilter=1073741848)
path = FilePath("C:\Users\jbren\Documents\GitHub\CDP-Smorgasbord\src\content\modules\25-establishing-and-achieving-building-targets\workingfiles\program requirements.xlsx")
excelread = ExcelReader(ReadExcelData=Toggle(True), WorkbookPath=path, WorksheetName="Sheet1")  # -> Exceptions, ExcelData
brep = Brep(pipeline)
brep_2 = Brep(pipeline_2)
list = ValueList({"ZONING 1": 0, "ZONING 2": 1}, selected="ZONING 1")
branch = TreeBranch(Tree=excelread.ExcelData, Path="{1}", MaintainPaths=True)
gate = StreamGate(Stream=brep, Gate=list)  # -> Target0, Target1
gate_2 = StreamGate(Stream=brep_2, Gate=list)  # -> Target0, Target1
item = ListItem(List=branch, Index=0, Wrap=True)  # -> Item, Item1, Item2, Item3, Item4
brep_envelope_for_analysis = Brep([gate.Target0, gate_2.Target1])
num_office_target = Number(item.Item1)
num_hotel_live_work_target = Number(item.Item2)
num_retail_target = Number(item.Item3)
