# Grasshopper definition establishing_key_2.gh (Grasshopper 1.0.8)
# plug-ins: LunchBox

pipeline = GeometryPipeline(
    GroupByLayer=False,
    GroupByType=False,
    IncludeHidden=True,
    IncludeLocked=True,
    LayerFilter="*CON_ZONING_ENVELOPE_1",
    NameFilter="*",
    SublayerFiltering=True,
    TypeFilter=1073741848)
pipeline_2 = GeometryPipeline(
    GroupByLayer=False,
    GroupByType=False,
    IncludeHidden=True,
    IncludeLocked=True,
    LayerFilter="*CON_ZONING_ENVELOPE_2",
    NameFilter="*",
    SublayerFiltering=True,
    TypeFilter=1073741848)
path = FilePath("C:\Users\jbren\Documents\GitHub\CDP-Smorgasbord\src\content\modules\25-establishing-and-achieving-building-targets\workingfiles\program requirements.xlsx")
office_floor_count = Slider(7, range=1..10)
hotel_floor_count = Slider(20, range=1..20)
pipeline_3 = GeometryPipeline(
    GroupByLayer=False,
    GroupByType=False,
    IncludeHidden=True,
    IncludeLocked=True,
    LayerFilter="*DP_OVERALL_MASSING",
    NameFilter="*",
    SublayerFiltering=True,
    TypeFilter=1073741848)
retail_floor_count = Slider(3, range=1..10)
office_f_to_f = Slider(14, range=10..20)
hotel_f_to_f = Slider(10, range=10..20)
retail_f_to_f = Slider(20, range=10..20)
excelread = ExcelReader(ReadExcelData=Toggle(True), WorkbookPath=path, WorksheetName="Sheet1")  # -> Exceptions, ExcelData
brep = Brep(pipeline)
brep_2 = Brep(pipeline_2)
list = ValueList({"ZONING 1": 0, "ZONING 2": 1}, selected="ZONING 1")
branch = TreeBranch(Tree=excelread.ExcelData, Path="{1}", MaintainPaths=True)
series = Series(Start=0, Step=retail_f_to_f, Count=retail_floor_count)
gate = StreamGate(Stream=brep, Gate=list)  # -> Target0, Target1
gate_2 = StreamGate(Stream=brep_2, Gate=list)  # -> Target0, Target1
item = ListItem(List=branch, Index=0, Wrap=True)  # -> Item, Item1, Item2, Item3, Item4
lng = ListLength(List=series)
brep_envelope_for_analysis = Brep([gate.Target0, gate_2.Target1])
num_office_target = Number(item.Item1)
num_hotel_live_work_target = Number(item.Item2)
num_retail_target = Number(item.Item3)
subtraction = Subtraction(A=lng, B="1")
item_2 = ListItem(List=series, Index=subtraction, Wrap=True)
addition = Addition(A=item_2, B=retail_f_to_f)
series_2 = Series(Start=addition, Step=office_f_to_f, Count=office_floor_count)
lng_2 = ListLength(List=series_2)
subtraction_2 = Subtraction(A=lng_2, B="1")
item_3 = ListItem(List=series_2, Index=subtraction_2, Wrap=True)
addition_2 = Addition(A=item_3, B=office_f_to_f)
series_3 = Series(Start=addition_2, Step=hotel_f_to_f, Count=hotel_floor_count)
pt = ConstructPoint(XCoordinate=0, YCoordinate=0, ZCoordinate=series)
retail_elevations = Panel(series)
pt_2 = ConstructPoint(XCoordinate=0, YCoordinate=0, ZCoordinate=series_2)
office_elevations = Panel(series_2)
hotel_elevations = Panel(series_3)
pt_3 = ConstructPoint(XCoordinate=0, YCoordinate=0, ZCoordinate=series_3)
num = Number()
xy = XYPlane(Origin=pt)
xy_2 = XYPlane(Origin=pt_2)
xy_3 = XYPlane(Origin=pt_3)
brep_3 = Brep(pipeline_3)
pln = Plane(xy)
pln_2 = Plane(xy_2)
pln_3 = Plane(xy_3)
entwine = Entwine(Branch00=pln, Branch01=pln_2, Branch02=pln_3, FlattenInputs=True)
sec = BrepPlane(Brep=brep_3, Plane=entwine)  # -> Curves, Points
entwine_2 = Entwine(Branch00=retail_f_to_f, Branch01=office_f_to_f, Branch02=hotel_f_to_f, FlattenInputs=True)
boundary = BoundarySurfaces(Edges=sec.Curves)
Z = UnitZ(Factor=entwine_2)
pshift = ShiftPaths(Data=boundary, Offset=-1)
extr = Extrude(Base=pshift, Direction=Z)
entwine_3 = Entwine(
    Branch00=ColourSwatch(SwatchColor=RGB(119, 255, 0)),
    Branch01=ColourSwatch(SwatchColor=RGB(0, 255, 255)),
    Branch02=ColourSwatch(SwatchColor=RGB(255, 0, 221)),
    FlattenInputs=True)
preview = CustomPreview(Geometry=pshift, Material=entwine_3)
area = Area(Geometry=pshift)  # -> Area, Centroid
ma = MassAddition(Input=area.Area)  # -> Result, PartialResults
round = Round(Number=ma.Result)  # -> Nearest, Floor, Ceiling
flatten = FlattenTree(Tree=round.Nearest, Path="{0}")
gross_up = Slider(0.04, range=0..1)
ma_2 = MassAddition(Input=flatten)  # -> Result, PartialResults
addition_3 = Addition(A=gross_up, B="1")
division = Division(A=ma_2.Result, B=addition_3)
