# Grasshopper definition 4-7_Complete.gh (Grasshopper 1.0.7)

elilipse_radius_1 = Slider(20, range=0..100)
elilipse_radius_2 = Slider(30, range=0..100)
pt = ConstructPoint(XCoordinate=0, YCoordinate=0, ZCoordinate=Slider(0, range=0..100))

# ----
# Rotation angle in degrees between each floor
rotation_step = Slider(0, range=0..40)

# ---- group: View Analysis Inputs
view_distance_threshold = Panel("100")
geo_obstructions = Geometry([<brep referenced from the Rhino model> x6])
max_view_distance = Panel("150")

# ----
num_view_distance_threshold = Number(view_distance_threshold)
num_floor_to_floor_height = Number(Slider(12, range=0..100))
num_number_of_floors = Number(Slider(14, range=0..100))
num_elilipse_radius_1 = Number(elilipse_radius_1)
num_elilipse_radius_2 = Number(elilipse_radius_2)
num_max_view_distance = Number(max_view_distance)
geo_obstructions_2 = Geometry(geo_obstructions)
num_rotation_step = Number(rotation_step)
pt_tower_location = Point(pt)

# ---- group: Moves and Rotates Tower Floors
series = Series(Start=0, Step=num_rotation_step, Count=num_number_of_floors)
series_2 = Series(Start=0, Step=num_floor_to_floor_height, Count=num_number_of_floors)
ellipse = Ellipse(Plane=pt_tower_location, Radius1=num_elilipse_radius_1, Radius2=num_elilipse_radius_2)  # -> Ellipse, Focus1, Focus2
Z = UnitZ(Factor=series_2)
rad = Radians(Degrees=series)
move = Move(Geometry=ellipse.Ellipse, Motion=Z)  # -> Geometry, Transform
rotate = Rotate(Geometry=move.Geometry, Angle=rad, Plane=PlaneXY(0, 0, 0))  # -> Geometry, Transform

# ----
num_rotation_step_2 = Number(num_rotation_step)
crv_rotated_tower_floors_curves = Curve(rotate.Geometry)

# ---- group: Subdivides Curve
len = Length(Curve=crv_rotated_tower_floors_curves)
division = Division(A=len, B="10")
round = Round(Number=division)  # -> Nearest, Floor, Ceiling
divide = DivideCurve(Curve=crv_rotated_tower_floors_curves, Count=round.Ceiling, Kinks=False)  # -> Points, Tangents, Parameters

# ----
Z_2 = UnitZ(Factor=num_floor_to_floor_height)
pt_floor_subdivisions = Point(divide.Points)
pt_floor_subdivisions_2 = Point(divide.Points)

# ---- group: Makes Panels
move_2 = Move(Geometry=pt_floor_subdivisions, Motion=Z_2)  # -> Geometry, Transform
shift = ShiftList(List=move_2.Geometry, Shift=1, Wrap=True)
shift_2 = ShiftList(List=pt_floor_subdivisions, Shift=1, Wrap=True)
srf4pt = _4PointSurface(CornerA=pt_floor_subdivisions, CornerB=shift_2, CornerC=shift, CornerD=move_2.Geometry)

# ---- group: Makes Floor and Ceiling Surfaces
pline = PolyLine(Vertices=pt_floor_subdivisions_2, Closed=Toggle(True))
boundary = BoundarySurfaces(Edges=pline)
move_3 = Move(Geometry=boundary, Motion=Z_2)  # -> Geometry, Transform

# ---- group: Intermediate Inputs
srf_floors = Surface(boundary)
srf_ceilings = Surface(move_3.Geometry)
srf_panels = Surface(srf4pt)

# ---- group: Inputs
num_view_distance_threshold_2 = Number(num_view_distance_threshold)
num_max_view_distance_2 = Number(num_max_view_distance)
srf_analysis_surfaces = Surface(srf_panels)
geo_obstructions_3 = Geometry(geo_obstructions_2)

# ----
mesh = Mesh(geo_obstructions_3)
mjoin = MeshJoin(Meshes=flatten(mesh))
num_view_distance_threshold_3 = Number(num_view_distance_threshold_2)
num_max_view_distance_3 = Number(num_max_view_distance_2)

# ---- group: Raycasting
evalsrf = EvaluateSurface(Surface=reparameterize(srf_analysis_surfaces), Point="{0.5,0.5,0}")  # -> Point, Normal, UDirection, VDirection, Frame
line = LineSDL(Start=evalsrf.Point, Direction=evalsrf.Normal, Length=1)
ivray = IsoVistRay(Sample=line, Radius=num_max_view_distance_3, Obstacles=mjoin)  # -> Point, Distance, Index

# ----
division_2 = Division(A=ivray.Distance, B=num_max_view_distance_3)

# ---- group: Scoring
larger = LargerThan(FirstNumber=ivray.Distance, SecondNumber=num_view_distance_threshold_3)  # -> LargerThan, OrEqualTo
avr = Average(Input=flatten(division_2))
ma = MassAddition(Input=flatten(larger.LargerThan))  # -> Result, PartialResults
lng = ListLength(List=flatten(larger.LargerThan))
division_3 = Division(A=ma.Result, B=lng)

# ----
bool_is_good_view = Boolean(larger.LargerThan)
gradient = Gradient(LowerLimit=0, UpperLimit=1, Parameter=division_2, stops=[0: RGB(227, 194, 255), 1: RGB(23, 124, 255)])
num_above_view_threshold = Number(division_3)
num_distance_per_window = Number(division_2)
bool_is_good_view_2 = Boolean(bool_is_good_view)
num_avg_open_view = Number(avr)
col_view_analysis_color = Colour(gradient)
bool_is_good_view_3 = Boolean(bool_is_good_view_2)
num_distance_per_window_2 = Number(num_distance_per_window)
srf_panels_2 = Surface(srf_panels)

# ---- group: Scaling by Distance
area = Area(Geometry=srf_panels_2)  # -> Area, Centroid
remap = RemapNumbers(Value=num_distance_per_window_2, Source=Domain(0, 1), Target=".8 to .4")  # -> Mapped, Clipped
scale = Scale(Geometry=srf_panels_2, Center=area.Centroid, Factor=remap.Mapped)  # -> Geometry, Transform

# ---- group: Scaling by Distance Threshold
bool_is_good_view_4 = Boolean(graft(bool_is_good_view_3))
srf_panels_3 = Surface(graft(srf_panels_2))
pt_center = Point(graft(area.Centroid))
dispatch = Dispatch(List=pt_center, DispatchPattern=bool_is_good_view_4)  # -> ListA, ListB
dispatch_2 = Dispatch(List=srf_panels_3, DispatchPattern=bool_is_good_view_4)  # -> ListA, ListB
scale_2 = Scale(Geometry=dispatch_2.ListB, Center=dispatch.ListB, Factor=".8")  # -> Geometry, Transform
scale_3 = Scale(Geometry=dispatch_2.ListA, Center=dispatch.ListA, Factor=".4")  # -> Geometry, Transform
merge = Merge(Data1=scale_3.Geometry, Data2=scale_2.Geometry)

# ---- group: Makes Widows
edges = BrepEdges(Brep=srf_panels_2)  # -> Naked, Interior, NonManifold
edges_2 = BrepEdges(Brep=merge)  # -> Naked, Interior, NonManifold
merge_2 = Merge(Data1=simplify(edges.Naked), Data2=simplify(edges_2.Naked))
boundary_2 = BoundarySurfaces(Edges=merge_2)
trim = TrimTree(Tree=boundary_2, Depth=1)
join = BrepJoin(Breps=trim)  # -> Breps, Closed

# ----
num_above_view_threshold_2 = Number(num_above_view_threshold)
col_view_analysis_color_2 = Colour(col_view_analysis_color)
num_avg_open_view_2 = Number(num_avg_open_view)
srf_analysis_surfaces_2 = Surface(srf_analysis_surfaces)

num_rotation_step_3 = Number(num_rotation_step_2)
num_iteration_number = Number(num_rotation_step_3)

# ---- group: Outputs
brep_walls = Brep(join.Breps)
srf_floors_2 = Surface(srf_floors)
srf_ceilings_2 = Surface(srf_ceilings)

# ---- group: Data Outputs
avg_open_view = Panel(num_avg_open_view_2)
above_view_threshold = Panel(num_above_view_threshold_2)

# ----
edges_3 = BrepEdges(Brep=brep_walls)  # -> Naked, Interior, NonManifold

# ---- group: Visualiztion
preview = CustomPreview(Geometry=srf_analysis_surfaces_2, Material=col_view_analysis_color_2)

# ----
merge_3 = Merge(Data1=edges_3.Naked, Data2=edges_3.Interior)
merge_4 = Merge(Data1=num_iteration_number, Data2=num_rotation_step_3, Data3=avg_open_view, Data4=above_view_threshold)
preview_2 = CustomPreview(Geometry=merge_3, Material=ColourSwatch(SwatchColor=RGB(0, 0, 0)))
preview_3 = CustomPreview(Geometry=brep_walls, Material=ColourSwatch(SwatchColor=RGB(255, 255, 255)))
join_2 = TextJoin(Text=merge_4, Join=",")
rec = DataRecorder(join_2, DataLimit=-10, RecordData=True)
data_to_csv = Panel(rec)
panel = Panel("Iteration#,Input1,Output1,Output2")
