# Grasshopper definition 4-8_Complete.gh (Grasshopper 1.0.7)

elilipse_radius_1 = Slider(20, range=0..100)
elilipse_radius_2 = Slider(30, range=0..100)
pt = ConstructPoint(XCoordinate=0, YCoordinate=0, ZCoordinate=Slider(0, range=0..100))

# ----
# Rotation angle in degrees between each floor
rotation_step = Slider(10, range=0..100)

# ---- group: View Analysis Inputs
view_distance_threshold = Panel("100")
geo_obstructions = Geometry([<brep referenced from the Rhino model> x6])
max_view_distance = Panel("150")

# ----
num_view_distance_threshold = Number(view_distance_threshold)
num_floor_to_floor_height = Number(Slider(12, range=0..100))
num_number_of_floors = Number(Slider(14, range=0..100))
num_elilipse_radius_1 = Number(elilipse_radius_1)
num_elilipse_radius_2 = Number(elilipse_radius_2)
num_max_view_distance = Number(max_view_distance)
geo_obstructions_2 = Geometry(geo_obstructions)
num_rotation_step = Number(rotation_step)
pt_tower_location = Point(pt)

# ---- group: Moves and Rotates Tower Floors
series = Series(Start=0, Step=num_rotation_step, Count=num_number_of_floors)
series_2 = Series(Start=0, Step=num_floor_to_floor_height, Count=num_number_of_floors)
ellipse = Ellipse(Plane=pt_tower_location, Radius1=num_elilipse_radius_1, Radius2=num_elilipse_radius_2)  # -> Ellipse, Focus1, Focus2
Z = UnitZ(Factor=series_2)
rad = Radians(Degrees=series)
move = Move(Geometry=ellipse.Ellipse, Motion=Z)  # -> Geometry, Transform
rotate = Rotate(Geometry=move.Geometry, Angle=rad, Plane=PlaneXY(0, 0, 0))  # -> Geometry, Transform

# ----
crv_rotated_tower_floors_curves = Curve(rotate.Geometry)

# ---- group: Subdivides Curve
len = Length(Curve=crv_rotated_tower_floors_curves)
division = Division(A=len, B="10")
round = Round(Number=division)  # -> Nearest, Floor, Ceiling
divide = DivideCurve(Curve=crv_rotated_tower_floors_curves, Count=round.Ceiling, Kinks=False)  # -> Points, Tangents, Parameters

# ----
Z_2 = UnitZ(Factor=num_floor_to_floor_height)
pt_floor_subdivisions = Point(divide.Points)
pt_floor_subdivisions_2 = Point(divide.Points)

# ---- group: Makes Panels
move_2 = Move(Geometry=pt_floor_subdivisions, Motion=Z_2)  # -> Geometry, Transform
shift = ShiftList(List=move_2.Geometry, Shift=1, Wrap=True)
shift_2 = ShiftList(List=pt_floor_subdivisions, Shift=1, Wrap=True)
srf4pt = _4PointSurface(CornerA=pt_floor_subdivisions, CornerB=shift_2, CornerC=shift, CornerD=move_2.Geometry)

# ---- group: Makes Floor and Ceiling Surfaces
pline = PolyLine(Vertices=pt_floor_subdivisions_2, Closed=Toggle(True))
boundary = BoundarySurfaces(Edges=pline)
move_3 = Move(Geometry=boundary, Motion=Z_2)  # -> Geometry, Transform

# ---- group: Intermediate Inputs
srf_floors = Surface(boundary)
srf_ceilings = Surface(move_3.Geometry)
srf_panels = Surface(srf4pt)

# ---- group: Inputs
num_view_distance_threshold_2 = Number(num_view_distance_threshold)
num_max_view_distance_2 = Number(num_max_view_distance)
srf_analysis_surfaces = Surface(srf_panels)
geo_obstructions_3 = Geometry(geo_obstructions_2)

# ---- group: Makes Widows
area = Area(Geometry=srf_panels)  # -> Area, Centroid
scale = Scale(Geometry=srf_panels, Center=area.Centroid, Factor=".7")  # -> Geometry, Transform
edges = BrepEdges(Brep=srf_panels)  # -> Naked, Interior, NonManifold
edges_2 = BrepEdges(Brep=scale.Geometry)  # -> Naked, Interior, NonManifold
merge = Merge(Data1=simplify(edges.Naked), Data2=simplify(edges_2.Naked))
boundary_2 = BoundarySurfaces(Edges=merge)
trim = TrimTree(Tree=boundary_2, Depth=1)
join = BrepJoin(Breps=trim)  # -> Breps, Closed

# ----
mesh = Mesh(geo_obstructions_3)
mjoin = MeshJoin(Meshes=flatten(mesh))
num_view_distance_threshold_3 = Number(num_view_distance_threshold_2)
num_max_view_distance_3 = Number(num_max_view_distance_2)

# ---- group: Raycasting
evalsrf = EvaluateSurface(Surface=reparameterize(srf_analysis_surfaces), Point="{0.5,0.5,0}")  # -> Point, Normal, UDirection, VDirection, Frame
line = LineSDL(Start=evalsrf.Point, Direction=evalsrf.Normal, Length=1)
ivray = IsoVistRay(Sample=line, Radius=num_max_view_distance_3, Obstacles=mjoin)  # -> Point, Distance, Index

# ----
division_2 = Division(A=ivray.Distance, B=num_max_view_distance_3)

# ---- group: Scoring
larger = LargerThan(FirstNumber=ivray.Distance, SecondNumber=num_view_distance_threshold_3)  # -> LargerThan, OrEqualTo
avr = Average(Input=flatten(division_2))
ma = MassAddition(Input=flatten(larger.LargerThan))  # -> Result, PartialResults
lng = ListLength(List=flatten(larger.LargerThan))
division_3 = Division(A=ma.Result, B=lng)

# ----
gradient = Gradient(LowerLimit=0, UpperLimit=1, Parameter=division_2, stops=[0: RGB(227, 194, 255), 1: RGB(23, 124, 255)])
srf_analysis_surfaces_2 = Surface(srf_analysis_surfaces)
num_above_view_threshold = Number(division_3)
num_avg_open_view = Number(avr)

# ---- group: Data Outputs
avg_open_view = Panel(num_avg_open_view)
above_view_threshold = Panel(num_above_view_threshold)

# ---- group: Outputs
brep_walls = Brep(join.Breps)
srf_floors_2 = Surface(srf_floors)
srf_ceilings_2 = Surface(srf_ceilings)

# ---- group: Visualiztion
preview = CustomPreview(Geometry=srf_analysis_surfaces_2, Material=gradient)
