# Grasshopper definition End of Dan Intro.gh (Grasshopper 1.0.7)

number_slider = Slider(12, range=0..100)
number_slider_2 = Slider(14, range=0..100)
pt = ConstructPoint(XCoordinate=0, YCoordinate=0, ZCoordinate=Slider(0, range=0..100))
series = Series(Start=0, Step=Slider(9, range=0..100), Count=number_slider_2)
series_2 = Series(Start=0, Step=number_slider, Count=number_slider_2)
ellipse = Ellipse(Plane=pt, Radius1=Slider(20, range=0..100), Radius2=Slider(30, range=0..100))  # -> Ellipse, Focus1, Focus2
Z = UnitZ(Factor=series_2)
rad = Radians(Degrees=series)
move = Move(Geometry=ellipse.Ellipse, Motion=Z)  # -> Geometry, Transform
Z_2 = UnitZ(Factor=number_slider)
rotate = Rotate(Geometry=move.Geometry, Angle=rad, Plane=PlaneXY(0, 0, 0))  # -> Geometry, Transform
len = Length(Curve=rotate.Geometry)
division = Division(A=len, B="10")
round = Round(Number=division)  # -> Nearest, Floor, Ceiling
divide = DivideCurve(Curve=rotate.Geometry, Count=round.Ceiling, Kinks=False)  # -> Points, Tangents, Parameters
pline = PolyLine(Vertices=divide.Points, Closed=Toggle(True))
move_2 = Move(Geometry=divide.Points, Motion=Z_2)  # -> Geometry, Transform
boundary = BoundarySurfaces(Edges=pline)
shift = ShiftList(List=move_2.Geometry, Shift=1, Wrap=True)
shift_2 = ShiftList(List=divide.Points, Shift=1, Wrap=True)
move_3 = Move(Geometry=boundary, Motion=Z_2)  # -> Geometry, Transform
srf4pt = _4PointSurface(CornerA=divide.Points, CornerB=shift_2, CornerC=shift, CornerD=move_2.Geometry)
area = Area(Geometry=srf4pt)  # -> Area, Centroid
scale = Scale(Geometry=srf4pt, Center=area.Centroid, Factor=".7")  # -> Geometry, Transform
edges = BrepEdges(Brep=srf4pt)  # -> Naked, Interior, NonManifold
edges_2 = BrepEdges(Brep=scale.Geometry)  # -> Naked, Interior, NonManifold
merge = Merge(Data1=simplify(edges.Naked), Data2=simplify(edges_2.Naked))
boundary_2 = BoundarySurfaces(Edges=merge)
trim = TrimTree(Tree=boundary_2, Depth=1)
join = BrepJoin(Breps=trim)  # -> Breps, Closed
merge_2 = Merge(Data1=simplify(join.Breps), Data2=simplify(boundary), Data3=simplify(move_3.Geometry))
