# Grasshopper definition Full Sequence Sketch.gh (Grasshopper 1.0.7)

number_slider = Slider(5, range=0..50)
number_slider_2 = Slider(12, range=0..100)
number_slider_3 = Slider(14, range=0..100)
pt = ConstructPoint(XCoordinate=0, YCoordinate=0, ZCoordinate=Slider(0, range=0..100))
int_option_number = Integer(number_slider)
series = Series(Start=0, Step=number_slider, Count=number_slider_3)
series_2 = Series(Start=0, Step=number_slider_2, Count=number_slider_3)
ellipse = Ellipse(Plane=pt, Radius1=Slider(20, range=0..100), Radius2=Slider(30, range=0..100))  # -> Ellipse, Focus1, Focus2
Z = UnitZ(Factor=series_2)
rad = Radians(Degrees=series)
move = Move(Geometry=ellipse.Ellipse, Motion=Z)  # -> Geometry, Transform
Z_2 = UnitZ(Factor=number_slider_2)
rotate = Rotate(Geometry=move.Geometry, Angle=rad, Plane=PlaneXY(0, 0, 0))  # -> Geometry, Transform
len = Length(Curve=rotate.Geometry)
division = Division(A=len, B="10")
round = Round(Number=division)  # -> Nearest, Floor, Ceiling
divide = DivideCurve(Curve=rotate.Geometry, Count=round.Ceiling, Kinks=False)  # -> Points, Tangents, Parameters
pline = PolyLine(Vertices=divide.Points, Closed=Toggle(True))
move_2 = Move(Geometry=divide.Points, Motion=Z_2)  # -> Geometry, Transform
boundary = BoundarySurfaces(Edges=pline)
shift = ShiftList(List=move_2.Geometry, Shift=1, Wrap=True)
shift_2 = ShiftList(List=divide.Points, Shift=1, Wrap=True)
move_3 = Move(Geometry=boundary, Motion=Z_2)  # -> Geometry, Transform
srf4pt = _4PointSurface(CornerA=divide.Points, CornerB=shift_2, CornerC=shift, CornerD=move_2.Geometry)
area = Area(Geometry=srf4pt)  # -> Area, Centroid
scale = Scale(Geometry=srf4pt, Center=area.Centroid, Factor=".7")  # -> Geometry, Transform
edges = BrepEdges(Brep=srf4pt)  # -> Naked, Interior, NonManifold
edges_2 = BrepEdges(Brep=scale.Geometry)  # -> Naked, Interior, NonManifold
merge = Merge(Data1=simplify(edges.Naked), Data2=simplify(edges_2.Naked))
boundary_2 = BoundarySurfaces(Edges=merge)
trim = TrimTree(Tree=boundary_2, Depth=1)
join = BrepJoin(Breps=trim)  # -> Breps, Closed
geo_obstructions = Geometry([<brep referenced from the Rhino model> x4])
geo_obstructions_2 = Geometry([<brep referenced from the Rhino model> x4])
srf_analysis_surface = Surface(srf4pt)
srf_analysis_surface_2 = Surface(srf4pt)
merge_2 = Merge(Data1=simplify(join.Breps), Data2=simplify(boundary), Data3=simplify(move_3.Geometry))
evalsrf = EvaluateSurface(Surface=reparameterize(srf_analysis_surface), Point="{0.5,0.5,0}")  # -> Point, Normal, UDirection, VDirection, Frame
evalsrf_2 = EvaluateSurface(Surface=reparameterize(srf_analysis_surface_2), Point="{0.5,0.5,0}")  # -> Point, Normal, UDirection, VDirection, Frame
panel = Panel(".4 to .9")
brep = Brep(graft(srf4pt))
line = LineSDL(Start=evalsrf.Point, Direction=evalsrf.Normal, Length=1)
line_2 = LineSDL(Start=evalsrf_2.Point, Direction=evalsrf_2.Normal, Length=1)
area_2 = Area(Geometry=srf4pt)  # -> Area, Centroid
cull = CullPattern(CullPattern=[False, False, True, True])
# Module 4
ivray = IsoVistRay(Sample=line, Radius="150", Obstacles=geo_obstructions)  # -> Point, Distance, Index
ivray_2 = IsoVistRay(Sample=line_2, Radius="150", Obstacles=geo_obstructions_2)  # -> Point, Distance, Index
# Module 2
meshray = MeshRay()  # -> Point, Hit
# Module 3
panel_2 = Panel("100")
int_option_index = Integer(int_option_number)
division_2 = Division(A=ivray.Distance, B="150")
division_3 = Division(A=ivray_2.Distance, B="150")
num_view_distance = Number(division_3)
remap = RemapNumbers(Value=num_view_distance, Source=Domain(0, 1), Target=".9 to .4")  # -> Mapped, Clipped
scale_2 = Scale(Geometry=srf4pt, Center=area_2.Centroid, Factor=remap.Mapped)  # -> Geometry, Transform
larger = LargerThan(FirstNumber=ivray.Distance, SecondNumber="100")  # -> LargerThan, OrEqualTo
larger_2 = LargerThan(FirstNumber=ivray_2.Distance, SecondNumber=panel_2)  # -> LargerThan, OrEqualTo
bool = Boolean(graft(larger_2.LargerThan))
dispatch = Dispatch(List=graft(area_2.Centroid), DispatchPattern=bool)  # -> ListA, ListB
dispatch_2 = Dispatch(List=brep, DispatchPattern=bool)  # -> ListA, ListB
scale_3 = Scale(Geometry=dispatch_2.ListB, Center=dispatch.ListB, Factor=".9")  # -> Geometry, Transform
scale_4 = Scale(Geometry=dispatch_2.ListA, Center=dispatch.ListA, Factor=".6")  # -> Geometry, Transform
merge_3 = Merge(Data1=scale_4.Geometry, Data2=scale_3.Geometry)
gradient = Gradient(LowerLimit=0, UpperLimit=1, Parameter=division_2, stops=[0: RGB(255, 222, 230), 1: RGB(220, 0, 40)])
gradient_2 = Gradient(LowerLimit=0, UpperLimit=1, Parameter=division_3, stops=[0: RGB(255, 222, 230), 1: RGB(220, 0, 40)])
edges_3 = BrepEdges(Brep=srf4pt)  # -> Naked, Interior, NonManifold
avr = Average(Input=flatten(division_2))
ma = MassAddition(Input=flatten(larger.LargerThan))  # -> Result, PartialResults
lng = ListLength(List=flatten(larger.LargerThan))
avr_2 = Average(Input=flatten(division_3))
ma_2 = MassAddition(Input=flatten(larger_2.LargerThan))  # -> Result, PartialResults
lng_2 = ListLength(List=flatten(larger_2.LargerThan))
trim_2 = TrimTree(Tree=merge_3, Depth=1)
edges_4 = BrepEdges(Brep=trim_2)  # -> Naked, Interior, NonManifold
merge_4 = Merge(Data1=simplify(edges_3.Naked), Data2=simplify(edges_4.Naked))
division_4 = Division(A=ma.Result, B=lng)
merge_5 = Merge(Data1=int_option_index, Data2=avr, Data3=division_4)
division_5 = Division(A=ma_2.Result, B=lng_2)
panel_3 = Panel(avr)
panel_4 = Panel(avr_2)
panel_5 = Panel(division_4)
boundary_3 = BoundarySurfaces(Edges=merge_4)
panel_6 = Panel(division_5)
join_2 = TextJoin(Text=merge_5, Join=",")
preview = CustomPreview(Geometry=srf_analysis_surface, Material=gradient)
preview_2 = CustomPreview(Geometry=srf_analysis_surface_2, Material=gradient_2)
trim_3 = TrimTree(Tree=boundary_3, Depth=1)
rec = DataRecorder(join_2, DataLimit=-10, RecordData=True)
join_3 = BrepJoin(Breps=trim_3)  # -> Breps, Closed
panel_7 = Panel(rec)
