# Grasshopper definition 5-3_Daylight.gh (Grasshopper 1.0.7)

day = Panel("15")
subdivision_size = Panel("15")
months = Panel("""3
4
5""")
srf_open_space = Surface(<surface referenced from the Rhino model>)
start_hour = Panel("8")
path_epw_file = FilePath("C:\Users\lwilson\Downloads\USA_NY_New.York-Central.Park.725033_TMY3\USA_NY_New.York-Central.Park.725033_TMY3.epw")
end_hour = Panel("18")
time_step = Panel("1")
subdivision_size_2 = Panel("12")
brep_design = Brep([<brep referenced from the Rhino model> x2])
geo_context = Geometry([<brep referenced from the Rhino model> x5])
int_months = Integer(graft(months))
path_epw_file_2 = FilePath(path_epw_file)
int_start_hour = Integer(start_hour)
int_end_hour = Integer(end_hour)
int_time_step = Integer(time_step)
int_day = Integer(day)
mesh_design = Mesh(flatten(brep_design))
mesh_context = Mesh(geo_context)
cluster = Cluster_2(brep_for_subdivision=brep_design, int_subdivision_size=subdivision_size_2)  # -> srf_analysis_surfaces_2, srf_horizontal_surfaces_2
cluster_2 = Cluster(srf_for_subdivision=srf_open_space, int_subdivision_size=subdivision_size)
mjoin = MeshJoin(Meshes=mesh_context)
analysisperiod = LBAnalysisPeriod(
    start_month=int_months,
    start_day=int_day,
    start_hour=int_start_hour,
    end_month=int_months,
    end_day=int_day,
    end_hour=int_end_hour,
    timestep=int_time_step)  # -> period, hoys, dates; plug-in component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
subtraction = Subtraction(A=int_end_hour, B=int_start_hour)
merge = Merge(Data1=mjoin, Data2=mesh_design)
addition = Addition(A=subtraction, B="1")
srf_horizontal_surfaces = Surface(cluster.srf_horizontal_surfaces_2)
evalsrf = EvaluateSurface(Surface=reparameterize(cluster_2), Point="{0.5,0.5,0}")  # -> Point, Normal, UDirection, VDirection, Frame
importloc = LBImportLocation(epw_file=path_epw_file_2)  # -> location; plug-in component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
mjoin_2 = MeshJoin(Meshes=flatten(merge))
preview = CustomPreview(Geometry=srf_horizontal_surfaces, Material=ColourSwatch(SwatchColor=RGB(255, 255, 255)))
mesh_obstructions = Mesh(mjoin_2)
sunpath = LBSunPath(location=importloc, hoys=analysisperiod.hoys, scale=1)  # -> report, vectors, altitudes, azimuths, hoys, sun_pts, analemma, daily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; plug-in component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
int_number_of_hours_tested = Integer(addition)
pt_analysis_points = Point(evalsrf.Point)
occ = Occlusion(Samples=pt_analysis_points, Obstructions=mesh_obstructions, Rays=sunpath.vectors)  # -> simplify(Hits), simplify(Occlusion)
not = GateNot(A=occ.Occlusion)
minimum_average_daylight_hours = Panel("3")
srf_analysis_surfaces = Surface(graft(cluster_2))
path_mapper = PathMapper(not, source="{A;B}", target="{B}")
ma = MassAddition(Input=path_mapper)  # -> Result, PartialResults
lng = ListLength(List=path_mapper)
minimum_average_daylight_hours_2 = Integer(minimum_average_daylight_hours)
int_number_of_hours_tested_2 = Integer(int_number_of_hours_tested)
division = Division(A=ma.Result, B=lng)
multiplication = Multiplication(A=division, B=int_number_of_hours_tested_2)
avr = Average(Input=flatten(division))
larger = LargerThan(FirstNumber=multiplication, SecondNumber=minimum_average_daylight_hours_2)  # -> LargerThan, flatten(OrEqualTo)
avr_2 = Average(Input=flatten(multiplication))
gradient = Gradient(
    LowerLimit=minimum_average_daylight_hours_2,
    UpperLimit="8",
    Parameter=multiplication,
    stops=[0: RGB(64, 64, 64), 0.5: RGB(255, 255, 0), 1: RGB(255, 0, 0)])
ma_2 = MassAddition(Input=larger.OrEqualTo)  # -> Result, PartialResults
lng_2 = ListLength(List=larger.OrEqualTo)
division_2 = Division(A=ma_2.Result, B=lng_2)
num_above_minimum_daylight_hours = Number(division_2)

num_average_of_day_with_daylight = Number(avr)
num_average_daylight_hours = Number(avr_2)
col_view_analysis_color = Colour(gradient)
srf_analysis_surfaces_2 = Surface(srf_analysis_surfaces)

# ---- group: Data Outputs
average_daylight_hours = Panel(num_average_daylight_hours)
average_of_day_with_daylight = Panel(num_average_of_day_with_daylight)

# ----
above_minimum_daylight_hours = Panel(num_above_minimum_daylight_hours)

# ---- group: Visualiztion
preview_2 = CustomPreview(Geometry=srf_analysis_surfaces_2, Material=col_view_analysis_color)

# ==== cluster Cluster
srf_for_subdivision = ClusterInput()
int_subdivision_size = ClusterInput()
srf_for_subdivision_2 = Surface(graft(srf_for_subdivision))
int_subdivision_size_2 = Integer(int_subdivision_size)
dim = Dimensions(Surface=srf_for_subdivision_2)  # -> UDimension, VDimension
division = Division(A=dim.UDimension, B=int_subdivision_size_2)
division_2 = Division(A=dim.VDimension, B=int_subdivision_size_2)
divide = DivideDomain²(Domain=srf_for_subdivision_2, UCount=division, VCount=division_2)
subsrf = Isotrim(Surface=srf_for_subdivision_2, Domain=divide)
srf_analysis_surfaces = Surface(subsrf)
srf_analysis_surfaces_2 = ClusterOutput(srf_analysis_surfaces)

# ==== cluster Cluster_2
brep_for_subdivision = ClusterInput()
brep_for_subdivision_2 = Brep(brep_for_subdivision)
debrep = DeconstructBrep(Brep=brep_for_subdivision_2)  # -> Faces, Edges, Vertices
evalsrf = EvaluateSurface(Surface=reparameterize(debrep.Faces), Point="{0.5,0.5,0}")  # -> Point, Normal, UDirection, VDirection, Frame
devec = DeconstructVector(Vector=evalsrf.Normal)  # -> XComponent, YComponent, ZComponent
abs = Absolute(Value=devec.ZComponent)
smaller = SmallerThan(FirstNumber=abs, SecondNumber=".9")  # -> SmallerThan, OrEqualTo
dispatch = Dispatch(List=debrep.Faces, DispatchPattern=smaller.SmallerThan)  # -> ListA, ListB
int_subdivision_size = ClusterInput()
srf_for_subdivision = Surface(graft(dispatch.ListA))
srf_horizontal_surfaces = Surface(dispatch.ListB)
int_subdivision_size_2 = Integer(int_subdivision_size)
srf_horizontal_surfaces_2 = ClusterOutput(srf_horizontal_surfaces)
dim = Dimensions(Surface=srf_for_subdivision)  # -> UDimension, VDimension
division = Division(A=dim.UDimension, B=int_subdivision_size_2)
division_2 = Division(A=dim.VDimension, B=int_subdivision_size_2)
divide = DivideDomain²(Domain=srf_for_subdivision, UCount=division, VCount=division_2)
subsrf = Isotrim(Surface=srf_for_subdivision, Domain=divide)
srf_analysis_surfaces = Surface(subsrf)
srf_analysis_surfaces_2 = ClusterOutput(srf_analysis_surfaces)
