# Grasshopper definition 5-4_Street_Grid.gh (Grasshopper 1.0.7)
# plug-ins: DeCodingSpaces

density_location = Slider(0, range=0..2)
pick_streets = Slider(0, range=0..2)
crv_boundary = Curve(<curve referenced from the Rhino model>)

crv_streets_1 = Curve([<curve referenced from the Rhino model> x4])
crv_streets_2 = Curve([<curve referenced from the Rhino model> x4])
crv_streets_3 = Curve([<curve referenced from the Rhino model> x10])

geo_center = Geometry(<point referenced from the Rhino model>)
geo_north = Geometry(<curve referenced from the Rhino model>)
geo_corners = Geometry([<point referenced from the Rhino model> x2])

int_density_location = Integer(density_location)
crv_streets_1_2 = Curve(crv_streets_1)
crv_streets_2_2 = Curve(crv_streets_2)
crv_streets_3_2 = Curve(crv_streets_3)
int_pick_streets = Integer(pick_streets)
geo_center_2 = Geometry(geo_center)
geo_north_2 = Geometry(geo_north)
geo_corners_2 = Geometry(geo_corners)
filter = StreamFilter(Gate=int_density_location, Stream0=geo_center_2, Stream1=geo_north_2, Stream2=geo_corners_2)
filter_2 = StreamFilter(Gate=int_pick_streets, Stream0=crv_streets_1_2, Stream1=crv_streets_2_2, Stream2=crv_streets_3_2)
crv_boundary_2 = Curve(crv_boundary)
crv_street_centerline = Curve(filter_2)
geo_density_location = Geometry(filter)

# ---- group: Creates Streets and Blocks
ext = ExtendCurve(Curve=crv_street_centerline, Type=0, Start="35", End="35")
crv_boundary_3 = Curve(crv_boundary_2)
street_size = Panel("""-35
35""")
offset = OffsetCurve(Curve=graft(ext), Distance=street_size, Corners=1)  # -> simplify(Curve)
trim = TrimTree(Tree=offset, Depth=1)
loft = Loft(Curves=trim, Options={Adjust=False, Closed=False, LoftEnds=0, LoftSimp=0, LoftType=0, Rebuild=10, Refit=0.01})  # -> flatten(Loft)
srfsplit = SurfaceSplit(Surface=crv_boundary_3, Curves=loft)
area = Area(Geometry=srfsplit)  # -> Area, Centroid
pull = PullPoint(Point=area.Centroid, Geometry=loft, ClosestOnly=True)  # -> ClosestPoint, Distance
int = Integer(pull.Distance)
equals = Equality(FirstNumber=int, SecondNumber="0")  # -> Equality, Inequality
dispatch = Dispatch(List=srfsplit, DispatchPattern=equals.Equality)  # -> ListA, ListB

# ----
geo_density_location_2 = Geometry(geo_density_location)
srf_blocks = Surface(dispatch.ListB)
srf_streets = Surface(dispatch.ListA)

# ---- group: Procedurally creates parcels based on density location
explode = Explode(Curve=srf_blocks, Recursive=True)  # -> Segments, Vertices
reb = RebuildCurve(Curve=explode.Segments, Degree="1", Count=10, Tangents=False)
pull_2 = PullPoint(Point=explode.Vertices, Geometry=geo_density_location_2, ClosestOnly=True)  # -> ClosestPoint, Distance
join = JoinCurves(Curves=reb, Preserve=False)
sort = SortList(Keys=pull_2.Distance)  # -> Keys, ValuesA
item = ListItem(List=sort.Keys, Index=0, Wrap=True)  # -> flatten(Item)
parcel_width_range = Panel("125 to 50")
bnd = Bounds(Numbers=item)
remap = RemapNumbers(Value=item, Source=bnd, Target=parcel_width_range)  # -> Mapped, Clipped
parcels = Parcels(Polygons=graft(join), ConnectionDistance=1, StreetOffset=0, PlotWidthThreshold=graft(remap.Mapped), Precision=100)

# ----
srf_blocks_2 = Surface(srf_blocks)
srf_streets_2 = Surface(srf_streets)

crv_parcels = Curve(graft(parcels))
srf_blocks_3 = Surface(srf_blocks_2)
Z = UnitZ(Factor=".25")
crv_parcels_2 = Curve(graft(crv_parcels))
move = Move(Geometry=srf_blocks_3, Motion=Z)  # -> Geometry, Transform
offset_2 = OffsetCurve(Curve=move.Geometry, Distance="10", Corners=1)
Z_2 = UnitZ(Factor="1")
mesh = Mesh(crv_parcels_2)
fillet = Fillet(Curve=offset_2, Radius="10")
move_2 = Move(Geometry=mesh, Motion=Z_2)  # -> Geometry, Transform
move_3 = Move(Geometry=crv_parcels_2, Motion=Z_2)  # -> Geometry, Transform
srf_streets_3 = Surface(srf_streets_2)
srf = Surface(fillet)
mesh_2 = Mesh(srf_streets_3)

preview = CustomPreview(Geometry=srf, Material=ColourSwatch(SwatchColor=RGB(135, 135, 135)))
preview_2 = CustomPreview(Geometry=move_3.Geometry, Material=ColourSwatch(SwatchColor=RGB(0, 0, 0)))
preview_3 = CustomPreview(Geometry=mesh_2, Material=ColourSwatch(SwatchColor=RGB(176, 176, 176)))
preview_4 = CustomPreview(Geometry=move_2.Geometry, Material=ColourSwatch(SwatchColor=RGB(255, 255, 255)))
