# Grasshopper definition 5-2_Subdivision.gh (Grasshopper 1.0.7)

brep_for_subdivision = Brep([<brep referenced from the Rhino model> x2])
subdivision_size = Panel("5")
subdivision_size_2 = Panel("5")
srf_for_subdivision = Surface([<surface referenced from the Rhino model> x3])
cluster = Cluster(srf_for_subdivision=srf_for_subdivision, int_subdivision_size=subdivision_size_2)
cluster_2 = Cluster_2(brep_for_subdivision=brep_for_subdivision, int_subdivision_size=subdivision_size)  # -> srf_analysis_surfaces_2, srf_horizontal_surfaces_2
srf_analysis_surfaces = Surface(cluster)
srf_horizontal_surfaces = Surface(cluster_2.srf_horizontal_surfaces_2)
srf_analysis_surfaces_2 = Surface(cluster_2.srf_analysis_surfaces_2)

# ==== cluster Cluster
srf_for_subdivision = ClusterInput()
int_subdivision_size = ClusterInput()
srf_for_subdivision_2 = Surface(graft(srf_for_subdivision))
int_subdivision_size_2 = Integer(int_subdivision_size)
dim = Dimensions(Surface=srf_for_subdivision_2)  # -> UDimension, VDimension
division = Division(A=dim.UDimension, B=int_subdivision_size_2)
division_2 = Division(A=dim.VDimension, B=int_subdivision_size_2)
divide = DivideDomain²(Domain=srf_for_subdivision_2, UCount=division, VCount=division_2)
subsrf = Isotrim(Surface=srf_for_subdivision_2, Domain=divide)
srf_analysis_surfaces = Surface(subsrf)
srf_analysis_surfaces_2 = ClusterOutput(srf_analysis_surfaces)

# ==== cluster Cluster_2
int_subdivision_size = ClusterInput()
brep_for_subdivision = ClusterInput()
brep_for_subdivision_2 = Brep(brep_for_subdivision)
debrep = DeconstructBrep(Brep=brep_for_subdivision_2)  # -> Faces, Edges, Vertices
evalsrf = EvaluateSurface(Surface=reparameterize(debrep.Faces), Point="{0.5,0.5,0}")  # -> Point, Normal, UDirection, VDirection, Frame
devec = DeconstructVector(Vector=evalsrf.Normal)  # -> XComponent, YComponent, ZComponent
abs = Absolute(Value=devec.ZComponent)
smaller = SmallerThan(FirstNumber=abs, SecondNumber=".9")  # -> SmallerThan, OrEqualTo
dispatch = Dispatch(List=debrep.Faces, DispatchPattern=smaller.SmallerThan)  # -> ListA, ListB
srf_for_subdivision = Surface(graft(dispatch.ListA))
srf_horizontal_surfaces = Surface(dispatch.ListB)
srf_horizontal_surfaces_2 = ClusterOutput(srf_horizontal_surfaces)
int_subdivision_size_2 = Integer(int_subdivision_size)
dim = Dimensions(Surface=srf_for_subdivision)  # -> UDimension, VDimension
division = Division(A=dim.UDimension, B=int_subdivision_size_2)
division_2 = Division(A=dim.VDimension, B=int_subdivision_size_2)
divide = DivideDomain²(Domain=srf_for_subdivision, UCount=division, VCount=division_2)
subsrf = Isotrim(Surface=srf_for_subdivision, Domain=divide)
srf_analysis_surfaces = Surface(subsrf)
srf_analysis_surfaces_2 = ClusterOutput(srf_analysis_surfaces)
