# Grasshopper definition 5-5_Buildings_Density.gh (Grasshopper 1.0.7)
# plug-ins: DeCodingSpaces, Human

# ----
# Selects the density range factor from the list above. 0 = even density, 1 = a range that goes from 0 to 2x your target density.
density_distribution_factor = Slider(4, range=0..4)

average_far = Panel("8")
density_distribution = Panel("""0.1
0.3
0.5
0.7
0.9""")
density_location = Slider(2, range=0..2)
pick_streets = Slider(2, range=0..2)

# ---- group: Building Types
geo_row_home = Geometry([<curve referenced from the Rhino model>, <brep referenced from the Rhino model>])
geo_midrise = Geometry([<curve referenced from the Rhino model>, <brep referenced from the Rhino model> x4])
geo_tower = Geometry([<curve referenced from the Rhino model>, <brep referenced from the Rhino model> x3])

# ----
crv_boundary = Curve(<curve referenced from the Rhino model>)

crv_streets_1 = Curve([<curve referenced from the Rhino model> x4])
crv_streets_2 = Curve([<curve referenced from the Rhino model> x4])
crv_streets_3 = Curve([<curve referenced from the Rhino model> x10])

geo_center = Geometry(<point referenced from the Rhino model>)
geo_north = Geometry(<curve referenced from the Rhino model>)
geo_corners = Geometry([<point referenced from the Rhino model> x2])

int_density_distribution_selection = Integer(density_distribution_factor)
int_density_location = Integer(density_location)
num_density_distribution = Number(density_distribution)
crv_streets_1_2 = Curve(crv_streets_1)
crv_streets_2_2 = Curve(crv_streets_2)
crv_streets_3_2 = Curve(crv_streets_3)
int_pick_streets = Integer(pick_streets)
geo_center_2 = Geometry(geo_center)
geo_north_2 = Geometry(geo_north)
geo_corners_2 = Geometry(geo_corners)
num_avg_far = Number(average_far)
geo_row_home_2 = Geometry(geo_row_home)
geo_tower_2 = Geometry(geo_tower)
geo_midrise_2 = Geometry(geo_midrise)
filter = StreamFilter(Gate=int_density_location, Stream0=geo_center_2, Stream1=geo_north_2, Stream2=geo_corners_2)
filter_2 = StreamFilter(Gate=int_pick_streets, Stream0=crv_streets_1_2, Stream1=crv_streets_2_2, Stream2=crv_streets_3_2)
item = ListItem(List=num_density_distribution, Index=int_density_distribution_selection, Wrap=True)
crv_boundary_2 = Curve(crv_boundary)
crv_street_centerline = Curve(filter_2)
geo_density_location = Geometry(filter)
num_density_distribution_2 = Number(item)

# ---- group: Creates Streets and Blocks
ext = ExtendCurve(Curve=crv_street_centerline, Type=0, Start="35", End="35")
# Parametric Streets, Blocks, and Parcels module
crv_boundary_3 = Curve(crv_boundary_2)
street_size = Panel("""-35
35""")
offset = OffsetCurve(Curve=graft(ext), Distance=street_size, Corners=1)  # -> simplify(Curve)
trim = TrimTree(Tree=offset, Depth=1)
loft = Loft(Curves=trim, Options={Adjust=False, Closed=False, LoftEnds=0, LoftSimp=0, LoftType=0, Rebuild=10, Refit=0.01})  # -> flatten(Loft)
srfsplit = SurfaceSplit(Surface=crv_boundary_3, Curves=loft)
area = Area(Geometry=srfsplit)  # -> Area, Centroid
pull = PullPoint(Point=area.Centroid, Geometry=loft, ClosestOnly=True)  # -> ClosestPoint, Distance
int = Integer(pull.Distance)
equals = Equality(FirstNumber=int, SecondNumber="0")  # -> Equality, Inequality
dispatch = Dispatch(List=srfsplit, DispatchPattern=equals.Equality)  # -> ListA, ListB

# ----
geo_density_location_2 = Geometry(geo_density_location)
srf_blocks = Surface(dispatch.ListB)
srf_streets = Surface(dispatch.ListA)

# ---- group: Procedurally creates parcels based on density location
explode = Explode(Curve=srf_blocks, Recursive=True)  # -> Segments, Vertices
reb = RebuildCurve(Curve=explode.Segments, Degree="1", Count=10, Tangents=False)
pull_2 = PullPoint(Point=explode.Vertices, Geometry=geo_density_location_2, ClosestOnly=True)  # -> ClosestPoint, Distance
join = JoinCurves(Curves=reb, Preserve=False)
sort = SortList(Keys=pull_2.Distance)  # -> Keys, ValuesA
item_2 = ListItem(List=sort.Keys, Index=0, Wrap=True)  # -> flatten(Item)
parcel_width_range = Panel("125 to 50")
bnd = Bounds(Numbers=item_2)
remap = RemapNumbers(Value=item_2, Source=bnd, Target=parcel_width_range)  # -> Mapped, Clipped
parcels = Parcels(Polygons=graft(join), ConnectionDistance=1, StreetOffset=0, PlotWidthThreshold=graft(remap.Mapped), Precision=100)

# ----
geo_density_location_3 = Geometry(geo_density_location_2)

srf_blocks_2 = Surface(srf_blocks)
srf_streets_2 = Surface(srf_streets)

crv_parcels = Curve(graft(parcels))
geo_density_location_4 = Geometry(geo_density_location_3)
crv_parcels_2 = Curve(crv_parcels)

# ---- group: Varyies Degree of Density Variation
num_density_distribution_3 = Number(num_density_distribution_2)
num_avg_far_2 = Number(num_avg_far)
addition = Addition(A=num_density_distribution_3, B="1")
subtraction = Subtraction(A="1", B=num_density_distribution_3)
multiplication = Multiplication(A=num_avg_far_2, B=addition)
multiplication_2 = Multiplication(A=num_avg_far_2, B=subtraction)
dom = ConstructDomain(DomainStart=multiplication, DomainEnd=multiplication_2)

# ---- group: Redistributes Density Based on Distance from Denstiy Location Geometry
# (1)
crv_parcels_3 = Curve(crv_parcels_2)
explode_2 = Explode(Curve=crv_parcels_3, Recursive=True)  # -> Segments, Vertices
pull_3 = PullPoint(Point=explode_2.Vertices, Geometry=geo_density_location_4, ClosestOnly=True)  # -> ClosestPoint, Distance
sort_2 = SortList(Keys=pull_3.Distance)  # -> Keys, ValuesA
item_3 = ListItem(List=sort_2.Keys, Index=0, Wrap=True)
bnd_2 = Bounds(Numbers=flatten(item_3))
remap_2 = RemapNumbers(Value=item_3, Source=bnd_2, Target=dom)  # -> simplify(Mapped), Clipped
num_far = Number(remap_2.Mapped)
crv_parcels_4 = Curve(crv_parcels_3)
area_2 = Area(Geometry=crv_parcels_4)  # -> Area, Centroid
multiplication_3 = Multiplication(A=area_2.Area, B=num_far)

# ---- group: Turns Parcels into Boxes
# (2)
srf_parcels = Surface(crv_parcels_2)
Z = UnitZ(Factor="100")
move = Move(Geometry=srf_parcels, Motion=Z)  # -> Geometry, Transform
# Procedural Density and Building Types module
# (3)
blendbox = BlendBox(SurfaceA=srf_parcels, DomainA=srf_parcels, SurfaceB=move.Geometry, DomainB=move.Geometry)

# ----
num_gfa = Number(multiplication_3)
num_far_2 = Number(num_far)

# ---- group: Dispatches Lots and GFA based on low, medium, and high FAR
medium_far_threshold = Panel("6")
high_far_threshold = Panel("10")
smaller = SmallerThan(FirstNumber=num_far_2, SecondNumber=medium_far_threshold)  # -> SmallerThan, OrEqualTo
smaller_2 = SmallerThan(FirstNumber=num_far_2, SecondNumber=high_far_threshold)  # -> SmallerThan, OrEqualTo
dispatch_2 = Dispatch(List=blendbox, DispatchPattern=smaller.SmallerThan)  # -> ALowDensityBox, ListB
dispatch_3 = Dispatch(List=num_gfa, DispatchPattern=smaller.SmallerThan)  # -> ListA, ListB
dispatch_4 = Dispatch(List=dispatch_2.ListB, DispatchPattern=smaller_2.SmallerThan)  # -> AMedDensityBox, BHighDensityBox
dispatch_5 = Dispatch(List=dispatch_3.ListB, DispatchPattern=smaller_2.SmallerThan)  # -> ListA, ListB

# ---- group: Creates Source Boxes and removes parcel lines
# (4)
geo_row_home_3 = Geometry(geo_row_home_2)
geo_midrise_3 = Geometry(geo_midrise_2)
geo_tower_3 = Geometry(geo_tower_2)
sortbytype = SortObjectsByType(RhinoObjects=geo_tower_3)  # -> Points, Curves, Surfaces, Breps, Meshes, TextObjects, HatchObjects, LightObjects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
sortbytype_2 = SortObjectsByType(RhinoObjects=geo_midrise_3)  # -> Points, Curves, Surfaces, Breps, Meshes, TextObjects, HatchObjects, LightObjects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
sortbytype_3 = SortObjectsByType(RhinoObjects=geo_row_home_3)  # -> Points, Curves, Surfaces, Breps, Meshes, TextObjects, HatchObjects, LightObjects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
bbox = BoundingBox(Content=geo_row_home_3, Plane=PlaneXY(0, 0, 0), UnionBox=True)  # -> B_Low_Density_Source, B
bbox_2 = BoundingBox(Content=geo_midrise_3, Plane=PlaneXY(0, 0, 0), UnionBox=True)  # -> B_Medium_Density_Source, B
bbox_3 = BoundingBox(Content=geo_tower_3, Plane=PlaneXY(0, 0, 0), UnionBox=True)  # -> B_High_Density_Source, B

# ----
num_medium_gfa = Number(dispatch_5.ListA)
num_high_gfa = Number(dispatch_5.ListB)
num_low_gfa = Number(dispatch_3.ListA)
brep_row_home = Brep(sortbytype_3.Breps)
brep_midrise = Brep(sortbytype_2.Breps)
brep_tower = Brep(sortbytype.Breps)
num_medium_gfa_2 = Number(num_medium_gfa)
num_high_gfa_2 = Number(num_high_gfa)
num_low_gfa_2 = Number(num_low_gfa)
brep_row_home_2 = Brep(brep_row_home)
brep_tower_2 = Brep(brep_tower)
brep_midrise_2 = Brep(brep_midrise)

crv_parcels_5 = Curve(graft(crv_parcels))
srf_blocks_3 = Surface(srf_blocks_2)
srf_streets_3 = Surface(srf_streets_2)

Z_2 = UnitZ(Factor=".25")
move_2 = Move(Geometry=srf_blocks_3, Motion=Z_2)  # -> Geometry, Transform
offset_2 = OffsetCurve(Curve=move_2.Geometry, Distance="10", Corners=1)
Z_3 = UnitZ(Factor="1")
mesh = Mesh(crv_parcels_5)
fillet = Fillet(Curve=offset_2, Radius="10")
move_3 = Move(Geometry=mesh, Motion=Z_3)  # -> Geometry, Transform
move_4 = Move(Geometry=crv_parcels_5, Motion=Z_3)  # -> Geometry, Transform
srf = Surface(fillet)
mesh_2 = Mesh(srf_streets_3)

preview = CustomPreview(Geometry=srf, Material=ColourSwatch(SwatchColor=RGB(135, 135, 135)))
preview_2 = CustomPreview(Geometry=move_4.Geometry, Material=ColourSwatch(SwatchColor=RGB(0, 0, 0)))
preview_3 = CustomPreview(Geometry=mesh_2, Material=ColourSwatch(SwatchColor=RGB(176, 176, 176)))
preview_4 = CustomPreview(Geometry=move_3.Geometry, Material=ColourSwatch(SwatchColor=RGB(183, 255, 125)))

# ---- group: Morphs source geometry into target boxes
floor_to_floor_height = Panel("12")
multiplication_4 = Multiplication(A=floor_to_floor_height, B=num_low_gfa_2)
multiplication_5 = Multiplication(A=floor_to_floor_height, B=num_high_gfa_2)
multiplication_6 = Multiplication(A=floor_to_floor_height, B=num_medium_gfa_2)
num_low_volume = Number(multiplication_4)
num_high_volume = Number(multiplication_5)
num_low_volume_2 = Number(multiplication_6)
geometry = Geometry()  # disabled

# ---- group: Morphs source geometry into target boxes / Medium Density
morph = BoxMorph(Geometry=brep_midrise_2, Reference=bbox_2.B_Medium_Density_Source, Target=dispatch_4.AMedDensityBox)
volume = Volume(Geometry=morph)  # -> Volume, Centroid
ma = MassAddition(Input=volume.Volume)  # -> Result, PartialResults
division = Division(A=num_low_volume_2, B=ma.Result)
scale_nu = ScaleNU(Geometry=morph, Plane=PlaneXY(0, 0, 0), ScaleX=1, ScaleY=1, ScaleZ=division)  # -> Geometry, Transform

# ---- group: Morphs source geometry into target boxes / Low Density
# (5)
morph_2 = BoxMorph(Geometry=brep_row_home_2, Reference=bbox.B_Low_Density_Source, Target=dispatch_2.ALowDensityBox)
volume_2 = Volume(Geometry=morph_2)  # -> Volume, Centroid
ma_2 = MassAddition(Input=volume_2.Volume)  # -> Result, PartialResults
division_2 = Division(A=num_low_volume, B=ma_2.Result)
scale_nu_2 = ScaleNU(Geometry=morph_2, Plane=PlaneXY(0, 0, 0), ScaleX=1, ScaleY=1, ScaleZ=division_2)  # -> Geometry, Transform

# ---- group: Morphs source geometry into target boxes / High Density
morph_3 = BoxMorph(Geometry=brep_tower_2, Reference=bbox_3.B_High_Density_Source, Target=dispatch_4.BHighDensityBox)
volume_3 = Volume(Geometry=morph_3)  # -> Volume, Centroid
ma_3 = MassAddition(Input=volume_3.Volume)  # -> Result, PartialResults
division_3 = Division(A=num_high_volume, B=ma_3.Result)
scale_nu_3 = ScaleNU(Geometry=morph_3, Plane=PlaneXY(0, 0, 0), ScaleX=1, ScaleY=1, ScaleZ=division_3)  # -> Geometry, Transform

# ---- group: Morphs source geometry into target boxes (continued)
merge = Merge(Data1=scale_nu_2.Geometry, Data2=scale_nu.Geometry, Data3=scale_nu_3.Geometry)

# ----
brep_buildings = Brep(merge)
mesh_3 = Mesh(brep_buildings)
edges = BrepEdges(Brep=brep_buildings)  # -> Naked, Interior, NonManifold
preview_5 = CustomPreview(
    Geometry=mesh_3,
    Material={diffuse=RGB(221, 160, 221), emission=RGB(66, 48, 66), shine=0.5, specular=RGB(255, 255, 255), transparency=0})
