# Grasshopper definition 5-7_Design-Space.gh (Grasshopper 1.0.7)

iteration = Slider(38, range=0..44)
density_location = Panel("""0
1
2""")
pick_streets = Panel("""0
1
2""")
series = Series(Start="0", Step="1", Count="5")
crossref = CrossReference(ListA=pick_streets, ListB=density_location, ListC=series, CrossMode=1)  # -> graft(ListA), graft(ListB), graft(ListC)
int_iteration_number = Integer(iteration)
merge = Merge(Data1=crossref.ListA, Data2=crossref.ListB, Data3=crossref.ListC)
join = TextJoin(Text=merge, Join=",")  # -> flatten(Result)
item = ListItem(List=join, Index=int_iteration_number, Wrap=True)
split = TextSplit(Text=item, Separators=",")
item_2 = ListItem(List=split, Index=0, Wrap=True)  # -> Item, Item1, Item2

# ----
# Selects the density range factor from the list above. 0 = even density, 1 = a range that goes from 0 to 2x your target density.
density_distribution_factor = Slider(4, range=0..4)

density_location_2 = Slider(2, range=0..2)
pick_streets_2 = Slider(2, range=0..2)
medium_far_threshold = Panel("6")
floor_to_floor_height = Panel("12")
high_far_threshold = Panel("10")
average_far = Panel("8")
density_distribution = Panel("""0.1
0.3
0.5
0.7
0.9""")
parcel_width_domain = Panel("125 to 50")

# ---- group: Building Types
geo_row_home = Geometry([<curve referenced from the Rhino model>, <brep referenced from the Rhino model>])
geo_tower = Geometry([<curve referenced from the Rhino model>, <brep referenced from the Rhino model> x3])
geo_midrise = Geometry([<curve referenced from the Rhino model>, <brep referenced from the Rhino model> x4])

# ----
int_iteration_number_2 = Integer(int_iteration_number)
street_size = Panel("""-35
35""")
int_street_option = Integer(item_2.Item)
crv_boundary = Curve(<curve referenced from the Rhino model>)

crv_streets_1 = Curve([<curve referenced from the Rhino model> x4])
crv_streets_3 = Curve([<curve referenced from the Rhino model> x10])
crv_streets_2 = Curve([<curve referenced from the Rhino model> x4])

int_density_location = Integer(item_2.Item1)

geo_center = Geometry(<point referenced from the Rhino model>)
geo_north = Geometry(<curve referenced from the Rhino model>)
geo_corners = Geometry([<point referenced from the Rhino model> x2])

int_density_distribution = Integer(item_2.Item2)

# ----
# Street Grid
blocks_and_parcels = BlocksAndParcels(
    crv_boundary=crv_boundary,
    int_pick_streets=int_street_option,
    crv_streets_1=crv_streets_1,
    crv_streets_2=crv_streets_2,
    crv_streets_3=crv_streets_3,
    int_street_size=street_size,
    int_density_location=int_density_location,
    geo_center=geo_center,
    geo_north=geo_north,
    geo_corners=geo_corners,
    domain_parcel_width_domain=parcel_width_domain)  # -> srf_streets_3, srf_blocks_3, crv_parcels_2, geo_density_location_4

# ----
# Buildings
buildings = Buildings(
    crv_parcels=blocks_and_parcels.crv_parcels_2,
    geo_density_location=blocks_and_parcels.geo_density_location_4,
    num_avg_far=average_far,
    num_density_distribution=density_distribution,
    int_density_distribution_selection=int_density_distribution,
    num_medium_far_threshold=medium_far_threshold,
    num_medium_far_threshold_2=high_far_threshold,
    num_floor_to_floor_height=floor_to_floor_height,
    geo_row_home=geo_row_home,
    geo_midrise=geo_midrise,
    geo_tower=geo_tower)

brep_buildings = Brep(buildings)
crv_parcels = Curve(graft(blocks_and_parcels.crv_parcels_2))
srf_blocks = Surface(blocks_and_parcels.srf_blocks_3)
# Geometry Visualization
srf_streets = Surface(blocks_and_parcels.srf_streets_3)

Z = UnitZ(Factor=".25")
move = Move(Geometry=srf_blocks, Motion=Z)  # -> Geometry, Transform
offset = OffsetCurve(Curve=move.Geometry, Distance="10", Corners=1)
mesh = Mesh(brep_buildings)
Z_2 = UnitZ(Factor="1")
mesh_2 = Mesh(crv_parcels)
fillet = Fillet(Curve=offset, Radius="10")
move_2 = Move(Geometry=mesh_2, Motion=Z_2)  # -> Geometry, Transform
move_3 = Move(Geometry=crv_parcels, Motion=Z_2)  # -> Geometry, Transform
srf = Surface(fillet)
mesh_3 = Mesh(srf_streets)
edges = BrepEdges(Brep=brep_buildings)  # -> Naked, Interior, NonManifold
preview = CustomPreview(
    Geometry=mesh,
    Material={diffuse=RGB(221, 160, 221), emission=RGB(66, 48, 66), shine=0.5, specular=RGB(255, 255, 255), transparency=0})

preview_2 = CustomPreview(Geometry=srf, Material=ColourSwatch(SwatchColor=RGB(135, 135, 135)))
preview_3 = CustomPreview(Geometry=move_3.Geometry, Material=ColourSwatch(SwatchColor=RGB(0, 0, 0)))
preview_4 = CustomPreview(Geometry=mesh_3, Material=ColourSwatch(SwatchColor=RGB(176, 176, 176)))
preview_5 = CustomPreview(Geometry=move_2.Geometry, Material=ColourSwatch(SwatchColor=RGB(183, 255, 125)))

srf_streets_2 = Surface(srf_streets)
brep_buildings_2 = Brep(brep_buildings)
explode = Explode(Curve=srf_streets_2, Recursive=True)  # -> Segments, Vertices
join_2 = JoinCurves(Curves=explode.Segments, Preserve=False)
boundary = BoundarySurfaces(Edges=join_2)
srf_rebuilt_streets = Surface(boundary)
# Analysis Prep
months = Panel("""6
7
8""")
day = Panel("15")
maximum_average_daylight_hours = Panel("9")
start_hour = Panel("6")
end_hour = Panel("20")
time_step = Panel("1")
brep_for_subdivision = Brep(brep_buildings_2)
subdivision_size = Panel("24")
day_2 = Panel("15")
minimum_average_daylight_hours = Panel("3")
months_2 = Panel("""3
4
5""")
start_hour_2 = Panel("8")

# ---- group: View Analysis Inputs
view_distance_threshold = Panel("80")
max_view_distance = Panel("600")

# ----
subdivision_size_2 = Panel("15")
end_hour_2 = Panel("18")
time_step_2 = Panel("1")
path_epw_file = FilePath("C:\Users\lwilson\Downloads\USA_NY_New.York-Central.Park.725033_TMY3\USA_NY_New.York-Central.Park.725033_TMY3.epw")
srf_open_space = Surface(srf_rebuilt_streets)
brep_design = Brep(brep_buildings_2)
geo_context = Geometry([<mesh referenced from the Rhino model> x13])
mesh_context = Mesh(flatten(geo_context))
mesh_design = Mesh(flatten(brep_design))
cluster = Cluster(srf_for_subdivision=srf_open_space, int_subdivision_size=subdivision_size_2)
cluster_2 = Cluster_3(brep_for_subdivision=brep_for_subdivision, int_subdivision_size=subdivision_size)  # -> srf_analysis_surfaces_2, srf_horizontal_surfaces_2
mjoin = MeshJoin(Meshes=mesh_context)
merge_2 = Merge(Data1=mjoin, Data2=mesh_design)
srf_analysis_surfaces = Surface(simplify(cluster_2.srf_analysis_surfaces_2))
srf_horizontal_surfaces = Surface(cluster_2.srf_horizontal_surfaces_2)
evalsrf = EvaluateSurface(Surface=reparameterize(cluster), Point="{0.5,0.5,0}")  # -> Point, Normal, UDirection, VDirection, Frame
mjoin_2 = MeshJoin(Meshes=flatten(merge_2))
evalsrf_2 = EvaluateSurface(Surface=reparameterize(srf_analysis_surfaces), Point="{0.5,0.5,0}")  # -> Point, Normal, UDirection, VDirection, Frame

# ----
# Daylight to Buildings
cluster_3 = Cluster_4(
    mesh_obstructions=mjoin_2,
    srf_analysis_surfaces=srf_analysis_surfaces,
    pt_analysis_points=evalsrf_2.Point,
    path_epw_file=path_epw_file,
    int_months=months,
    int_day=day,
    int_start_hour=start_hour,
    int_end_hour=end_hour,
    int_time_step=time_step,
    minimum_average_daylight_hours=maximum_average_daylight_hours)  # -> srf_analysis_surfaces_4, col_view_analysis_color_2, num_average_daylight_hours_2, num_average_of_day_with_daylight_2, num_below_maximum_daylight_hours_2

# ----
# Views from Buildings
cluster_4 = Cluster_5(
    srf_analysis_surfaces=srf_analysis_surfaces,
    geo_obstructions=mjoin_2,
    num_max_view_distance=max_view_distance,
    num_view_distance_threshold=view_distance_threshold)  # -> srf_analysis_surfaces_4, col_view_analysis_color_2, num_avg_open_view_2, num_above_view_threshold_2

# ----
# Daylight to Streets
cluster_5 = Cluster_2(
    mesh_obstructions=mjoin_2,
    srf_analysis_surfaces=cluster,
    pt_analysis_points=evalsrf.Point,
    path_epw_file=path_epw_file,
    int_months=months_2,
    int_day=day_2,
    int_start_hour=start_hour_2,
    int_end_hour=end_hour_2,
    int_time_step=time_step_2,
    minimum_average_daylight_hours=minimum_average_daylight_hours)  # -> srf_analysis_surfaces_4, col_view_analysis_color_2, num_average_daylight_hours_2, num_average_of_day_with_daylight_2, num_above_minimum_daylight_hours_2

srf_horizontal_surfaces_2 = Surface(srf_horizontal_surfaces)

num_above_view_threshold = Number(cluster_4.num_above_view_threshold_2)
col_view_analysis_color = Colour(cluster_4.col_view_analysis_color_2)
num_avg_open_view = Number(cluster_4.num_avg_open_view_2)
srf_analysis_surfaces_2 = Surface(cluster_4.srf_analysis_surfaces_4)

num_below_maximum_daylight_hours = Number(cluster_3.num_below_maximum_daylight_hours_2)

# ---- group: Data Outputs
average_daylight_hours = Panel(cluster_3.num_average_daylight_hours_2)
average_of_day_with_daylight = Panel(cluster_3.num_average_of_day_with_daylight_2)
below_maximum_daylight_hours = Panel(cluster_3.num_below_maximum_daylight_hours_2)

average_daylight_hours_2 = Panel(cluster_5.num_average_daylight_hours_2)
average_of_day_with_daylight_2 = Panel(cluster_5.num_average_of_day_with_daylight_2)
above_minimum_daylight_hours = Panel(cluster_5.num_above_minimum_daylight_hours_2)

# ----
num_above_minimum_daylight_hours = Number(cluster_5.num_above_minimum_daylight_hours_2)

# ---- group: Data Outputs
avg_open_view = Panel(num_avg_open_view)
above_view_threshold = Panel(num_above_view_threshold)

# ----
num_average_daylight_hours = Number(cluster_5.num_average_daylight_hours_2)

# ---- group: Visualiztion
preview_6 = CustomPreview(Geometry=srf_analysis_surfaces_2, Material=col_view_analysis_color)

preview_7 = CustomPreview(Geometry=cluster_3.srf_analysis_surfaces_4, Material=cluster_3.col_view_analysis_color_2)

# ----
preview_8 = CustomPreview(Geometry=srf_horizontal_surfaces_2, Material=ColourSwatch(SwatchColor=RGB(255, 255, 255)))

# ---- group: Visualiztion
preview_9 = CustomPreview(Geometry=cluster_5.srf_analysis_surfaces_4, Material=cluster_5.col_view_analysis_color_2)

# ---- group: Outputs
num_above_minimum_daylight_hours_2 = Number(num_above_minimum_daylight_hours)
num_average_daylight_hours_2 = Number(num_average_daylight_hours)
num_above_view_threshold_2 = Number(num_above_view_threshold)
num_below_maximum_daylight_hours_2 = Number(num_below_maximum_daylight_hours)

# ---- group: Iinputs
int_density_distribution_2 = Integer(int_density_distribution)
int_density_location_2 = Integer(int_density_location)
int_street_option_2 = Integer(int_street_option)

# ----
int_iteration_number_3 = Integer(int_iteration_number_2)
merge_3 = Merge(
    Data1=flatten(int_iteration_number_3),
    Data2=flatten(int_street_option_2),
    Data3=flatten(int_density_location_2),
    Data4=flatten(int_density_distribution_2),
    Data5=flatten(num_below_maximum_daylight_hours_2),
    Data6=flatten(num_average_daylight_hours_2),
    Data7=flatten(num_above_minimum_daylight_hours_2),
    Data8=flatten(num_above_view_threshold_2))
column_headings = Panel("Interation,In:Street,In:Density-Location,In:Density-Distribution,Out:Building-Daylight,Out:Street-Avg-Daylight,Out:Street-Min-Daylight,Out:Buildings-Views")
join_3 = TextJoin(Text=merge_3, Join=",")
# 2) Turn on Record
# 1) Clear Recorder
rec = DataRecorder(join_3, DataLimit=-10, RecordData=False)
# 3) Right-click -> Stream Contents -> "Data.csv"
merge_4 = Merge(Data1=column_headings, Data2=rec)
output_to_vsc = Panel(merge_4)

# ==== cluster BlocksAndParcels
int_density_location = ClusterInput()
int_street_size = ClusterInput()
crv_streets_1 = ClusterInput()
crv_streets_2 = ClusterInput()
crv_streets_3 = ClusterInput()
domain_parcel_width_domain = ClusterInput()
geo_corners = ClusterInput()
int_pick_streets = ClusterInput()
geo_center = ClusterInput()
geo_north = ClusterInput()
int_density_location_2 = Integer(int_density_location)
int_street_size_2 = Integer(int_street_size)
crv_streets_1_2 = Curve(crv_streets_1)
crv_streets_2_2 = Curve(crv_streets_2)
crv_streets_3_2 = Curve(crv_streets_3)
domain_parcel_width_domain_2 = Domain(domain_parcel_width_domain)
geo_corners_2 = Geometry(geo_corners)
int_pick_streets_2 = Integer(int_pick_streets)
geo_center_2 = Geometry(geo_center)
geo_north_2 = Geometry(geo_north)
filter = StreamFilter(Gate=int_density_location_2, Stream0=geo_center_2, Stream1=geo_north_2, Stream2=geo_corners_2)
filter_2 = StreamFilter(Gate=int_pick_streets_2, Stream0=crv_streets_1_2, Stream1=crv_streets_2_2, Stream2=crv_streets_3_2)
crv_boundary = ClusterInput()
crv_boundary_2 = Curve(crv_boundary)
crv_street_centerline = Curve(filter_2)
geo_density_location = Geometry(filter)
ext = ExtendCurve(Curve=crv_street_centerline, Type=0, Start="35", End="35")
crv_boundary_3 = Curve(crv_boundary_2)
int_street_size_3 = Integer(int_street_size_2)
offset = OffsetCurve(Curve=graft(ext), Distance=int_street_size_3, Corners=1)  # -> simplify(Curve)
trim = TrimTree(Tree=offset, Depth=1)
loft = Loft(Curves=trim, Options={Adjust=False, Closed=False, LoftEnds=0, LoftSimp=0, LoftType=0, Rebuild=10, Refit=0.01})  # -> flatten(Loft)
srfsplit = SurfaceSplit(Surface=crv_boundary_3, Curves=loft)
area = Area(Geometry=srfsplit)  # -> Area, Centroid
pull = PullPoint(Point=area.Centroid, Geometry=loft, ClosestOnly=True)  # -> ClosestPoint, Distance
int = Integer(pull.Distance)
equals = Equality(FirstNumber=int, SecondNumber="0")  # -> Equality, Inequality
dispatch = Dispatch(List=srfsplit, DispatchPattern=equals.Equality)  # -> ListA, ListB
geo_density_location_2 = Geometry(geo_density_location)
srf_blocks = Surface(dispatch.ListB)
srf_streets = Surface(dispatch.ListA)
explode = Explode(Curve=srf_blocks, Recursive=True)  # -> Segments, Vertices
geo_density_location_3 = Geometry(geo_density_location_2)
reb = RebuildCurve(Curve=explode.Segments, Degree="1", Count=10, Tangents=False)
geo_density_location_4 = ClusterOutput(geo_density_location_3)
srf_blocks_2 = Surface(srf_blocks)
srf_streets_2 = Surface(srf_streets)
pull_2 = PullPoint(Point=explode.Vertices, Geometry=geo_density_location_2, ClosestOnly=True)  # -> ClosestPoint, Distance
srf_blocks_3 = ClusterOutput(srf_blocks_2)
srf_streets_3 = ClusterOutput(srf_streets_2)
join = JoinCurves(Curves=reb, Preserve=False)
sort = SortList(Keys=pull_2.Distance)  # -> Keys, ValuesA
item = ListItem(List=sort.Keys, Index=0, Wrap=True)  # -> flatten(Item)
domain_parcel_width_domain_3 = Domain(domain_parcel_width_domain_2)
bnd = Bounds(Numbers=item)
remap = RemapNumbers(Value=item, Source=bnd, Target=domain_parcel_width_domain_3)  # -> Mapped, Clipped
parcels = Parcels(Polygons=graft(join), ConnectionDistance=1, StreetOffset=0, PlotWidthThreshold=graft(remap.Mapped), Precision=100)
# Parcels
crv_parcels = Curve(graft(parcels))
crv_parcels_2 = ClusterOutput(crv_parcels)

# ==== cluster Buildings
int_density_distribution_selection = ClusterInput()
num_floor_to_floor_height = ClusterInput()
num_medium_far_threshold = ClusterInput()
num_medium_far_threshold_2 = ClusterInput()
num_density_distribution = ClusterInput()
num_avg_far = ClusterInput()
geo_row_home = ClusterInput()
geo_tower = ClusterInput()
geo_midrise = ClusterInput()
int_density_distribution_selection_2 = Integer(int_density_distribution_selection)
num_floor_to_floor_height_2 = Number(num_floor_to_floor_height)
num_medium_far_threshold_3 = Number(num_medium_far_threshold)
num_medium_far_threshold_4 = Number(num_medium_far_threshold_2)
num_density_distribution_2 = Number(num_density_distribution)
num_avg_far_2 = Number(num_avg_far)
geo_row_home_2 = Geometry(geo_row_home)
geo_tower_2 = Geometry(geo_tower)
geo_midrise_2 = Geometry(geo_midrise)
item = ListItem(List=num_density_distribution_2, Index=int_density_distribution_selection_2, Wrap=True)
num_density_distribution_3 = Number(item)
geo_density_location = ClusterInput()
crv_parcels = ClusterInput()
geo_density_location_2 = Geometry(geo_density_location)
crv_parcels_2 = Curve(crv_parcels)
num_density_distribution_4 = Number(num_density_distribution_3)
crv_parcels_3 = Curve(crv_parcels_2)
num_avg_far_3 = Number(num_avg_far_2)
explode = Explode(Curve=crv_parcels_3, Recursive=True)  # -> Segments, Vertices
pull = PullPoint(Point=explode.Vertices, Geometry=geo_density_location_2, ClosestOnly=True)  # -> ClosestPoint, Distance
addition = Addition(A=num_density_distribution_4, B="1")
subtraction = Subtraction(A="1", B=num_density_distribution_4)
sort = SortList(Keys=pull.Distance)  # -> Keys, ValuesA
multiplication = Multiplication(A=num_avg_far_3, B=addition)
multiplication_2 = Multiplication(A=num_avg_far_3, B=subtraction)
item_2 = ListItem(List=sort.Keys, Index=0, Wrap=True)
num_medium_far_threshold_5 = Number(num_medium_far_threshold_4)
num_medium_far_threshold_6 = Number(num_medium_far_threshold_3)
dom = ConstructDomain(DomainStart=multiplication, DomainEnd=multiplication_2)
bnd = Bounds(Numbers=flatten(item_2))
remap = RemapNumbers(Value=item_2, Source=bnd, Target=dom)  # -> simplify(Mapped), Clipped
srf_parcels = Surface(crv_parcels_2)
num_far = Number(remap.Mapped)
Z = UnitZ(Factor="100")
crv_parcels_4 = Curve(crv_parcels_3)
move = Move(Geometry=srf_parcels, Motion=Z)  # -> Geometry, Transform
area = Area(Geometry=crv_parcels_4)  # -> Area, Centroid
blendbox = BlendBox(SurfaceA=srf_parcels, DomainA=srf_parcels, SurfaceB=move.Geometry, DomainB=move.Geometry)
multiplication_3 = Multiplication(A=area.Area, B=num_far)
num_gfa = Number(multiplication_3)
num_medium_far_threshold_7 = Number(num_medium_far_threshold_6)
num_far_2 = Number(num_far)
num_hight_far_threshold = Number(num_medium_far_threshold_5)
smaller = SmallerThan(FirstNumber=num_far_2, SecondNumber=num_medium_far_threshold_7)  # -> SmallerThan, OrEqualTo
smaller_2 = SmallerThan(FirstNumber=num_far_2, SecondNumber=num_hight_far_threshold)  # -> SmallerThan, OrEqualTo
dispatch = Dispatch(List=blendbox, DispatchPattern=smaller.SmallerThan)  # -> ALowDensityBox, ListB
dispatch_2 = Dispatch(List=num_gfa, DispatchPattern=smaller.SmallerThan)  # -> ListA, ListB
geo_row_home_3 = Geometry(geo_row_home_2)
geo_midrise_3 = Geometry(geo_midrise_2)
geo_tower_3 = Geometry(geo_tower_2)
sortbytype = SortObjectsByType(RhinoObjects=geo_tower_3)  # -> Points, Curves, Surfaces, Breps, Meshes, TextObjects, HatchObjects, LightObjects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
sortbytype_2 = SortObjectsByType(RhinoObjects=geo_midrise_3)  # -> Points, Curves, Surfaces, Breps, Meshes, TextObjects, HatchObjects, LightObjects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
sortbytype_3 = SortObjectsByType(RhinoObjects=geo_row_home_3)  # -> Points, Curves, Surfaces, Breps, Meshes, TextObjects, HatchObjects, LightObjects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
bbox = BoundingBox(Content=geo_row_home_3, Plane=PlaneXY(0, 0, 0), UnionBox=True)  # -> B_Low_Density_Source, B
bbox_2 = BoundingBox(Content=geo_midrise_3, Plane=PlaneXY(0, 0, 0), UnionBox=True)  # -> B_Medium_Density_Source, B
bbox_3 = BoundingBox(Content=geo_tower_3, Plane=PlaneXY(0, 0, 0), UnionBox=True)  # -> B_High_Density_Source, B
dispatch_3 = Dispatch(List=dispatch.ListB, DispatchPattern=smaller_2.SmallerThan)  # -> AMedDensityBox, BHighDensityBox
dispatch_4 = Dispatch(List=dispatch_2.ListB, DispatchPattern=smaller_2.SmallerThan)  # -> ListA, ListB
brep_row_home = Brep(sortbytype_3.Breps)
brep_midrise = Brep(sortbytype_2.Breps)
brep_tower = Brep(sortbytype.Breps)
num_medium_gfa = Number(dispatch_4.ListA)
num_high_gfa = Number(dispatch_4.ListB)
num_low_gfa = Number(dispatch_2.ListA)
num_floor_to_floor_height_3 = Number(num_floor_to_floor_height_2)
num_medium_gfa_2 = Number(num_medium_gfa)
num_high_gfa_2 = Number(num_high_gfa)
num_low_gfa_2 = Number(num_low_gfa)
brep_row_home_2 = Brep(brep_row_home)
brep_tower_2 = Brep(brep_tower)
brep_midrise_2 = Brep(brep_midrise)
morph = BoxMorph(Geometry=brep_midrise_2, Reference=bbox_2.B_Medium_Density_Source, Target=dispatch_3.AMedDensityBox)
morph_2 = BoxMorph(Geometry=brep_row_home_2, Reference=bbox.B_Low_Density_Source, Target=dispatch.ALowDensityBox)
morph_3 = BoxMorph(Geometry=brep_tower_2, Reference=bbox_3.B_High_Density_Source, Target=dispatch_3.BHighDensityBox)
volume = Volume(Geometry=morph_2)  # -> Volume, Centroid
multiplication_4 = Multiplication(A=num_floor_to_floor_height_3, B=num_low_gfa_2)
volume_2 = Volume(Geometry=morph)  # -> Volume, Centroid
multiplication_5 = Multiplication(A=num_floor_to_floor_height_3, B=num_high_gfa_2)
multiplication_6 = Multiplication(A=num_floor_to_floor_height_3, B=num_medium_gfa_2)
volume_3 = Volume(Geometry=morph_3)  # -> Volume, Centroid
ma = MassAddition(Input=volume.Volume)  # -> Result, PartialResults
num_low_volume = Number(multiplication_4)
num_high_volume = Number(multiplication_5)
num_low_volume_2 = Number(multiplication_6)
ma_2 = MassAddition(Input=volume_2.Volume)  # -> Result, PartialResults
ma_3 = MassAddition(Input=volume_3.Volume)  # -> Result, PartialResults
division = Division(A=num_low_volume, B=ma.Result)
division_2 = Division(A=num_low_volume_2, B=ma_2.Result)
division_3 = Division(A=num_high_volume, B=ma_3.Result)
scale_nu = ScaleNU(Geometry=morph_2, Plane=PlaneXY(0, 0, 0), ScaleX=1, ScaleY=1, ScaleZ=division)  # -> Geometry, Transform
scale_nu_2 = ScaleNU(Geometry=morph, Plane=PlaneXY(0, 0, 0), ScaleX=1, ScaleY=1, ScaleZ=division_2)  # -> Geometry, Transform
scale_nu_3 = ScaleNU(Geometry=morph_3, Plane=PlaneXY(0, 0, 0), ScaleX=1, ScaleY=1, ScaleZ=division_3)  # -> Geometry, Transform
merge = Merge(Data1=scale_nu.Geometry, Data2=scale_nu_2.Geometry, Data3=scale_nu_3.Geometry)
geometry = Geometry()  # disabled
brep_buildings = Brep(merge)
brep_buildings_2 = ClusterOutput(brep_buildings)

# ==== cluster Cluster
srf_for_subdivision = ClusterInput()
int_subdivision_size = ClusterInput()
srf_for_subdivision_2 = Surface(graft(srf_for_subdivision))
int_subdivision_size_2 = Integer(int_subdivision_size)
dim = Dimensions(Surface=srf_for_subdivision_2)  # -> UDimension, VDimension
division = Division(A=dim.UDimension, B=int_subdivision_size_2)
division_2 = Division(A=dim.VDimension, B=int_subdivision_size_2)
divide = DivideDomain²(Domain=srf_for_subdivision_2, UCount=division, VCount=division_2)
subsrf = Isotrim(Surface=srf_for_subdivision_2, Domain=divide)
srf_analysis_surfaces = Surface(subsrf)
srf_analysis_surfaces_2 = ClusterOutput(srf_analysis_surfaces)

# ==== cluster Cluster_2
path_epw_file = ClusterInput()
int_start_hour = ClusterInput()
int_end_hour = ClusterInput()
int_time_step = ClusterInput()
int_months = ClusterInput()
int_day = ClusterInput()
path_epw_file_2 = FilePath(path_epw_file)
int_start_hour_2 = Integer(int_start_hour)
int_end_hour_2 = Integer(int_end_hour)
int_time_step_2 = Integer(int_time_step)
int_months_2 = Integer(int_months)
int_day_2 = Integer(int_day)
analysisperiod = LBAnalysisPeriod(
    start_month=int_months_2,
    start_day=int_day_2,
    start_hour=int_start_hour_2,
    end_month=int_months_2,
    end_day=int_day_2,
    end_hour=int_end_hour_2,
    timestep=int_time_step_2)  # -> period, hoys, dates; plug-in component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
subtraction = Subtraction(A=int_end_hour_2, B=int_start_hour_2)
importloc = LBImportLocation(epw_file=path_epw_file_2)  # -> location; plug-in component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
addition = Addition(A=subtraction, B="1")
int_number_of_hours_tested = Integer(addition)
srf_analysis_surfaces = ClusterInput()
pt_analysis_points = ClusterInput()
mesh_obstructions = ClusterInput()
pt_analysis_points_2 = Point(simplify(flatten(pt_analysis_points)))
sunpath = LBSunPath(location=importloc, hoys=analysisperiod.hoys, scale=1)  # -> report, vectors, altitudes, azimuths, hoys, sun_pts, analemma, daily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; plug-in component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
srf_analysis_surfaces_2 = Surface(flatten(srf_analysis_surfaces))
mesh_obstructions_2 = Mesh(mesh_obstructions)
minimum_average_daylight_hours = ClusterInput()
minimum_average_daylight_hours_2 = Integer(minimum_average_daylight_hours)
occ = Occlusion(Samples=pt_analysis_points_2, Obstructions=mesh_obstructions_2, Rays=sunpath.vectors)  # -> Hits, simplify(Occlusion)
not = GateNot(A=occ.Occlusion)
path_mapper = PathMapper(not, source=["{A;B}", "{A}"], target=["{B}", "{A}"])
ma = MassAddition(Input=path_mapper)  # -> Result, PartialResults
lng = ListLength(List=path_mapper)
int_number_of_hours_tested_2 = Integer(int_number_of_hours_tested)
division = Division(A=ma.Result, B=lng)
multiplication = Multiplication(A=division, B=int_number_of_hours_tested_2)
avr = Average(Input=flatten(division))
larger = LargerThan(FirstNumber=multiplication, SecondNumber=minimum_average_daylight_hours_2)  # -> LargerThan, flatten(OrEqualTo)
avr_2 = Average(Input=flatten(multiplication))
gradient = Gradient(
    LowerLimit=minimum_average_daylight_hours_2,
    UpperLimit="8",
    Parameter=multiplication,
    stops=[0: RGB(64, 64, 64), 0.5: RGB(255, 255, 0), 1: RGB(255, 0, 0)])
ma_2 = MassAddition(Input=larger.OrEqualTo)  # -> Result, PartialResults
lng_2 = ListLength(List=larger.OrEqualTo)
division_2 = Division(A=ma_2.Result, B=lng_2)

num_above_minimum_daylight_hours = Number(division_2)
num_average_of_day_with_daylight = Number(avr)
num_average_daylight_hours = Number(avr_2)
srf_analysis_surfaces_3 = Surface(graft(srf_analysis_surfaces_2))
col_view_analysis_color = Colour(gradient)

srf_analysis_surfaces_4 = ClusterOutput(srf_analysis_surfaces_3)
col_view_analysis_color_2 = ClusterOutput(col_view_analysis_color)
num_average_daylight_hours_2 = ClusterOutput(num_average_daylight_hours)
num_average_of_day_with_daylight_2 = ClusterOutput(num_average_of_day_with_daylight)
num_above_minimum_daylight_hours_2 = ClusterOutput(num_above_minimum_daylight_hours)

# ==== cluster Cluster_3
brep_for_subdivision = ClusterInput()
brep_for_subdivision_2 = Brep(brep_for_subdivision)
debrep = DeconstructBrep(Brep=brep_for_subdivision_2)  # -> Faces, Edges, Vertices
evalsrf = EvaluateSurface(Surface=reparameterize(debrep.Faces), Point="{0.5,0.5,0}")  # -> Point, Normal, UDirection, VDirection, Frame
devec = DeconstructVector(Vector=evalsrf.Normal)  # -> XComponent, YComponent, ZComponent
abs = Absolute(Value=devec.ZComponent)
smaller = SmallerThan(FirstNumber=abs, SecondNumber=".9")  # -> SmallerThan, OrEqualTo
dispatch = Dispatch(List=debrep.Faces, DispatchPattern=smaller.SmallerThan)  # -> ListA, ListB
int_subdivision_size = ClusterInput()
srf_for_subdivision = Surface(graft(dispatch.ListA))
srf_horizontal_surfaces = Surface(dispatch.ListB)
int_subdivision_size_2 = Integer(int_subdivision_size)
srf_horizontal_surfaces_2 = ClusterOutput(srf_horizontal_surfaces)
dim = Dimensions(Surface=srf_for_subdivision)  # -> UDimension, VDimension
division = Division(A=dim.UDimension, B=int_subdivision_size_2)
division_2 = Division(A=dim.VDimension, B=int_subdivision_size_2)
divide = DivideDomain²(Domain=srf_for_subdivision, UCount=division, VCount=division_2)
subsrf = Isotrim(Surface=srf_for_subdivision, Domain=divide)
srf_analysis_surfaces = Surface(subsrf)
srf_analysis_surfaces_2 = ClusterOutput(srf_analysis_surfaces)

# ==== cluster Cluster_4
path_epw_file = ClusterInput()
int_start_hour = ClusterInput()
int_end_hour = ClusterInput()
int_time_step = ClusterInput()
int_months = ClusterInput()
int_day = ClusterInput()
path_epw_file_2 = FilePath(path_epw_file)
int_start_hour_2 = Integer(int_start_hour)
int_end_hour_2 = Integer(int_end_hour)
int_time_step_2 = Integer(int_time_step)
int_months_2 = Integer(int_months)
int_day_2 = Integer(int_day)
analysisperiod = LBAnalysisPeriod(
    start_month=int_months_2,
    start_day=int_day_2,
    start_hour=int_start_hour_2,
    end_month=int_months_2,
    end_day=int_day_2,
    end_hour=int_end_hour_2,
    timestep=int_time_step_2)  # -> period, hoys, dates; plug-in component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
subtraction = Subtraction(A=int_end_hour_2, B=int_start_hour_2)
importloc = LBImportLocation(epw_file=path_epw_file_2)  # -> location; plug-in component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
addition = Addition(A=subtraction, B="1")
int_number_of_hours_tested = Integer(addition)
srf_analysis_surfaces = ClusterInput()
pt_analysis_points = ClusterInput()
mesh_obstructions = ClusterInput()
pt_analysis_points_2 = Point(simplify(flatten(pt_analysis_points)))
sunpath = LBSunPath(location=importloc, hoys=analysisperiod.hoys, scale=1)  # -> report, vectors, altitudes, azimuths, hoys, sun_pts, analemma, daily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; plug-in component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
srf_analysis_surfaces_2 = Surface(flatten(srf_analysis_surfaces))
mesh_obstructions_2 = Mesh(mesh_obstructions)
minimum_average_daylight_hours = ClusterInput()
occ = Occlusion(Samples=pt_analysis_points_2, Obstructions=mesh_obstructions_2, Rays=sunpath.vectors)  # -> Hits, simplify(Occlusion)
not = GateNot(A=occ.Occlusion)
path_mapper = PathMapper(not, source=["{A;B}", "{A}"], target=["{B}", "{A}"])
ma = MassAddition(Input=path_mapper)  # -> Result, PartialResults
lng = ListLength(List=path_mapper)
int_number_of_hours_tested_2 = Integer(int_number_of_hours_tested)
division = Division(A=ma.Result, B=lng)
minimum_average_daylight_hours_2 = Integer(minimum_average_daylight_hours)
multiplication = Multiplication(A=division, B=int_number_of_hours_tested_2)
avr = Average(Input=flatten(division))
smaller = SmallerThan(FirstNumber=multiplication, SecondNumber=minimum_average_daylight_hours_2)  # -> SmallerThan, flatten(OrEqualTo)
avr_2 = Average(Input=flatten(multiplication))
gradient = Gradient(
    LowerLimit="1",
    UpperLimit=minimum_average_daylight_hours_2,
    Parameter=multiplication,
    stops=[0: RGB(64, 64, 64), 0.5: RGB(255, 255, 0), 1: RGB(255, 128, 0)])
ma_2 = MassAddition(Input=smaller.OrEqualTo)  # -> Result, PartialResults
lng_2 = ListLength(List=smaller.OrEqualTo)
division_2 = Division(A=ma_2.Result, B=lng_2)

num_below_maximum_daylight_hours = Number(division_2)
num_average_of_day_with_daylight = Number(avr)
num_average_daylight_hours = Number(avr_2)
srf_analysis_surfaces_3 = Surface(graft(srf_analysis_surfaces_2))
col_view_analysis_color = Colour(gradient)

srf_analysis_surfaces_4 = ClusterOutput(srf_analysis_surfaces_3)
col_view_analysis_color_2 = ClusterOutput(col_view_analysis_color)
num_average_daylight_hours_2 = ClusterOutput(num_average_daylight_hours)
num_average_of_day_with_daylight_2 = ClusterOutput(num_average_of_day_with_daylight)
num_below_maximum_daylight_hours_2 = ClusterOutput(num_below_maximum_daylight_hours)

# ==== cluster Cluster_5
num_view_distance_threshold = ClusterInput()
num_max_view_distance = ClusterInput()
srf_analysis_surfaces = ClusterInput()
geo_obstructions = ClusterInput()

# ---- group: Inputs
num_view_distance_threshold_2 = Number(num_view_distance_threshold)
srf_analysis_surfaces_2 = Surface(flatten(srf_analysis_surfaces))
num_max_view_distance_2 = Number(num_max_view_distance)
geo_obstructions_2 = Geometry(geo_obstructions)

# ----
num_view_distance_threshold_3 = Number(num_view_distance_threshold_2)
num_max_view_distance_3 = Number(num_max_view_distance_2)
srf_analysis_surfaces_3 = Surface(graft(srf_analysis_surfaces_2))
srf_analysis_surfaces_4 = ClusterOutput(srf_analysis_surfaces_3)

# ---- group: Raycasting
evalsrf = EvaluateSurface(Surface=reparameterize(graft(srf_analysis_surfaces_2)), Point="{0.5,0.5,0}")  # -> Point, Normal, UDirection, VDirection, Frame
series = Series(Start="-60", Step="15", Count="9")

# ----
amp = Amplitude(Vector=evalsrf.Normal, Amplitude=".5")
move = Move(Geometry=evalsrf.Point, Motion=amp)  # -> Geometry, Transform

# ---- group: Raycasting (continued)
line = LineSDL(Start=move.Geometry, Direction=evalsrf.Normal, Length=1)
rotate = Rotate(Geometry=line, Angle=degrees(series), Plane=evalsrf.Point)  # -> Geometry, Transform
ivray = IsoVistRay(Sample=rotate.Geometry, Radius=num_max_view_distance_3, Obstacles=geo_obstructions_2)  # -> Point, Distance, Index

# ----
avr = Average(Input=ivray.Distance)
division = Division(A=avr, B=num_max_view_distance_3)

# ---- group: Scoring
larger = LargerThan(FirstNumber=ivray.Distance, SecondNumber=num_view_distance_threshold_3)  # -> LargerThan, OrEqualTo
avr_2 = Average(Input=flatten(division))
ma = MassAddition(Input=flatten(larger.LargerThan))  # -> Result, PartialResults
lng = ListLength(List=flatten(larger.LargerThan))
division_2 = Division(A=ma.Result, B=lng)

# ----
gradient = Gradient(LowerLimit=0, UpperLimit=1, Parameter=division, stops=[0: RGB(227, 194, 255), 1: RGB(23, 124, 255)])
num_above_view_threshold = Number(division_2)
num_avg_open_view = Number(avr_2)
col_view_analysis_color = Colour(gradient)
num_avg_open_view_2 = ClusterOutput(num_avg_open_view)
col_view_analysis_color_2 = ClusterOutput(col_view_analysis_color)
num_above_view_threshold_2 = ClusterOutput(num_above_view_threshold)
