# Grasshopper definition Parcelization.gh (Grasshopper 1.0.8)

panel = Panel("""5
10
20""")
curve_blocks = Curve([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])
parcels = CSharpScript(polygons=graft(curve_blocks), plotWidthThreshold=graft(panel))  # -> out, Parcels; inputs polygons: list of Curve, streetOffset: Double, plotWidthThreshold: Double
# ---------- parcels: C# ----------
// Grasshopper Script Instance
#region Usings
using System;
using System.Linq;
using System.Collections;
using System.Collections.Generic;
using System.Drawing;

using Rhino;
using Rhino.Geometry;
using Rhino.Geometry.Collections;
using Rhino.Geometry.Intersect;

using Grasshopper;
using Grasshopper.Kernel;
using Grasshopper.Kernel.Data;
using Grasshopper.Kernel.Types;
#endregion

public class Script_Instance : GH_ScriptInstance
{
    #region Notes
    /* 
      Members:
        RhinoDoc RhinoDocument
        GH_Document GrasshopperDocument
        IGH_Component Component
        int Iteration

      Methods (Virtual & overridable):
        Print(string text)
        Print(string format, params object[] args)
        Reflect(object obj)
        Reflect(object obj, string method_name)
    */
    #endregion

    private void RunScript(
		List<Curve> polygons,
		double streetOffset,
		double plotWidthThreshold,
		ref object Parcels)
    {
        if (polygons == null) return;
        foreach (Curve crv in polygons)
        {
        // Set block boundary from street offset value
        Curve block = crv;
        if (streetOffset != 0) block = offsetCurve(crv, Plane.WorldXY, -streetOffset);
        blockOrigin = block;

        // Set the frame for splitting direction from minimum bounding box
        List<Point3d> points = GetPoints(block);
        Plane frame = SetFrame(points);

        // Split parcel recursively
        List<Curve> parcels = SplitParcel(block, plotWidthThreshold, frame, remainingIteration);

        // outputs
        Parcels = parcels;
        }
    }

    // maximum iteration of SplitParcel recursion
    int remainingIteration = 5;
    Curve blockOrigin;

    private List<Curve> SplitParcel(Curve curve, double plotWidthThreshold, Plane frame, int remainingIteration)
    {
        // Early exit: plotWidthTheshold is not provided
        if (plotWidthThreshold == 0)
        {
        Component.AddRuntimeMessage(GH_RuntimeMessageLevel.Warning, "plot width threshold for parcels is not provided!");
        return new List<Curve> {curve};
        }

        // Get minimum bounding box
        List<Point3d> points = GetPoints(curve);
        Rectangle3d boundingBox = GetBoundingBox(points, frame);
        double tol = RhinoDocument.ModelAbsoluteTolerance;

        // Split the parcel
        List<Line> splitLines = GetSplitLine(boundingBox.ToPolyline(), plotWidthThreshold);

        if(splitLines.Count > 0 && remainingIteration > 0)
        {
        List<Curve> parcels = new List<Curve>();
        foreach (Line splitLine in splitLines)
        {
            if (parcels.Count >= 2)
            {
            continue;
            }

            CurveIntersections inter = Intersection.CurveCurve(curve.ToNurbsCurve(), splitLine.ToNurbsCurve(), tol, tol);
            double[] parameters = new double[2];

            if (inter.Count == 2)
            {
            parameters[0] = inter[0].ParameterA;
            parameters[1] = inter[1].ParameterA;
            }

            // Sanity check on geometry
            else if (inter.Count > 2)
            {
            Component.AddRuntimeMessage(GH_RuntimeMessageLevel.Error, "polygons contain convex geometry!");
            return new List<Curve> {curve};
            }

            Curve[] curves = curve.Split(parameters);
            for (int i = 0, n = curves.Length; i < n; i++)
            {
            Curve closingCrv = new LineCurve(curves[i].PointAtStart, curves[i].PointAtEnd);
            Curve closedCrv = Curve.JoinCurves(new Curve[] {closingCrv, curves[i]})[0];
            curves[i] = closedCrv;
            }

            // Check if any parcel is isolated from roads
            bool invalidParcel = false;
            foreach (Curve parcel in curves)
            {
            int adjacentPts = 0;
            foreach (Point3d pt in GetPoints(parcel))
            {
                double t = 0;
                blockOrigin.ClosestPoint(pt, out t);
                double dist = pt.DistanceToSquared(blockOrigin.PointAt(t));
                if (dist < tol) adjacentPts++;
            }
            if (adjacentPts < 2) invalidParcel = true;
            }

            if (invalidParcel)
            {
            continue;
            }
            else
            {
            parcels.AddRange(new List<Curve>(curves));
            }
        }

        // Base case: return itself when any parcel is isolated from roads
        if (parcels.Count < 2)
        {
            return new List<Curve> {curve};
        }

        // Recursion: split parcels
        remainingIteration--;
        List<Curve> parcelA = SplitParcel(parcels[0], plotWidthThreshold, frame, remainingIteration);
        List<Curve> parcelB = SplitParcel(parcels[1], plotWidthThreshold, frame, remainingIteration);
        List<Curve> parcelAB = new List<Curve>();
        parcelAB.AddRange(parcelA);
        parcelAB.AddRange(parcelB);

        return parcelAB;
        }

        // Base case: return itself when parcel has no split lines
        else
        {
        return new List<Curve> {curve};
        }
    }


    private List<Point3d> GetPoints(Curve curve)
    {
        List<Point3d> points = new List<Point3d>();
        NurbsCurvePointList ptList = curve.ToNurbsCurve().Points;
        for (int i = 0, n = ptList.Count; i < n; i++)
        {
        points.Add(ptList[i].Location);
        }

        return points;
    }


    private Plane SetFrame(List<Point3d> points)
    {
        // Get oriented bounding boxes
        List<Plane> planes = new List<Plane>();
        List<Rectangle3d> rects = new List<Rectangle3d>();

        for (int i = 0, n = points.Count - 1; i < n; i++)
        {
        Vector3d vecX = points[i + 1] - points[i];
        Vector3d vecY = points[i + 1] - points[i];
        vecY.Rotate(Math.PI * 0.5, Vector3d.ZAxis);
        vecX.Unitize();
        vecY.Unitize();
        Plane plane = new Plane(points[i], vecX, vecY);
        planes.Add(plane);

        // Get min and max for orientedX,Y
        double xMin = double.MaxValue;
        double xMax = double.MinValue;
        double yMin = double.MaxValue;
        double yMax = double.MinValue;
        foreach (Point3d otherPt in points)
        {
            double x = Vector3d.Multiply((otherPt - points[i]), vecX);
            double y = Vector3d.Multiply((otherPt - points[i]), vecY);
            xMin = Math.Min(xMin, x);
            xMax = Math.Max(xMax, x);
            yMin = Math.Min(yMin, y);
            yMax = Math.Max(yMax, y);
        }

        Point3d cornerA = points[i] + vecX * xMax + vecY * yMax;
        Point3d cornerB = points[i] + vecX * xMin + vecY * yMin;
        rects.Add(new Rectangle3d(plane, cornerA, cornerB));
        }

        // Get a frame from the minimum bounding box
        Rectangle3d rectMin = rects[0];
        Plane frameMin = planes[0];
        for (int i = 0, n = rects.Count; i < n; i++)
        {
        if (rectMin.Area > rects[i].Area)
        {
            rectMin = rects[i];
            frameMin = planes[i];
        }
        }

        return frameMin;
    }


    private Rectangle3d GetBoundingBox(List<Point3d> points, Plane frame)
    {
        // Get a bounding box with given frame
        Rectangle3d bBox = Rectangle3d.Unset;
        for (int i = 0, n = points.Count - 1; i < n; i++)
        {
        Vector3d vecX = points[i + 1] - points[i];
        Vector3d vecY = points[i + 1] - points[i];
        vecY.Rotate(Math.PI * 0.5, Vector3d.ZAxis);
        vecX.Unitize();
        vecY.Unitize();
        Plane plane = new Plane(points[i], vecX, vecY);

        // Exit if plane is not parallel to the given frame
        if (plane.XAxis.IsParallelTo(frame.XAxis) != 1) continue;

        // Get min and max for orientedX,Y
        double xMin = double.MaxValue;
        double xMax = double.MinValue;
        double yMin = double.MaxValue;
        double yMax = double.MinValue;
        foreach (Point3d otherPt in points)
        {
            double x = Vector3d.Multiply((otherPt - points[i]), vecX);
            double y = Vector3d.Multiply((otherPt - points[i]), vecY);
            xMin = Math.Min(xMin, x);
            xMax = Math.Max(xMax, x);
            yMin = Math.Min(yMin, y);
            yMax = Math.Max(yMax, y);
        }

        Point3d cornerA = points[i] + vecX * xMax + vecY * yMax;
        Point3d cornerB = points[i] + vecX * xMin + vecY * yMin;
        bBox = new Rectangle3d(plane, cornerA, cornerB);
        }

        return bBox;
    }


    private List<Line> GetSplitLine(Polyline bBox, double plotWidthThreshold)
    {
        List<Line> longLines = new List<Line>();
        List<Line> shortLines = new List<Line>();
        List<Line> splitLines = new List<Line>();

        if (bBox.SegmentCount != 4)
        {
        Component.AddRuntimeMessage(GH_RuntimeMessageLevel.Error, "bounding box is not correctly created");
        }

        if (bBox.SegmentAt(0).Length >= bBox.SegmentAt(1).Length)
        {
        longLines.Add(bBox.SegmentAt(0));
        longLines.Add(bBox.SegmentAt(2));
        shortLines.Add(bBox.SegmentAt(1));
        shortLines.Add(bBox.SegmentAt(3));
        }
        else
        {
        longLines.Add(bBox.SegmentAt(1));
        longLines.Add(bBox.SegmentAt(3));
        shortLines.Add(bBox.SegmentAt(0));
        shortLines.Add(bBox.SegmentAt(2));
        }

        if (longLines[0].Length > plotWidthThreshold * 2.0)
        {
        double half = longLines[0].Length / 2;
        Point3d pt1 = longLines[0].PointAtLength(half);
        Point3d pt2 = longLines[1].PointAtLength(half);
        splitLines.Add(new Line(pt1, pt2));
        }

        if (shortLines[0].Length > plotWidthThreshold * 2.0)
        {
        double half = shortLines[0].Length / 2;
        Point3d pt1 = shortLines[0].PointAtLength(half);
        Point3d pt2 = shortLines[1].PointAtLength(half);
        splitLines.Add(new Line(pt1, pt2));
        }

        return splitLines;
    }


    private Curve offsetCurve(Curve curve, Plane frame, double distance)
    {
        double tol = RhinoDocument.ModelAbsoluteTolerance;
        Curve[] offsets = curve.Offset(frame, distance, tol, CurveOffsetCornerStyle.Sharp);

        // Sanity check
        if (offsets == null || offsets.Length == 0)
        {
        Component.AddRuntimeMessage(GH_RuntimeMessageLevel.Warning, "failed to offset the original curve");
        return curve;
        }

        Curve[] joint = Curve.JoinCurves(offsets);

        if (joint == null || joint.Length > 1)
        {
        Component.AddRuntimeMessage(GH_RuntimeMessageLevel.Warning, "failed to offset the original curve");
        return curve;
        }

        return joint[0];
    }
}
# ---------- end parcels ----------
