# Grasshopper definition Average  Daylight Hours_Done2.gh (Grasshopper 1.0.7)

end_hour = Panel("18")
start_hour = Panel("8")
month = Panel("4")
day = Panel("21")
path_weather_file = FilePath("C:\Users\lwilson\Downloads\USA_NY_New.York-Central.Park.725033_TMY3\USA_NY_New.York-Central.Park.725033_TMY3.epw")
geo_obstructions = Geometry([<brep referenced from the Rhino model> x7])
srf_surfaces_to_analyze = Surface([<surface referenced from the Rhino model> x2])
brep_building_to_analyze = Brep([<brep referenced from the Rhino model> x2])
num_start_hour = Number(start_hour)
num_end_hour = Number(end_hour)
num_month = Number(graft(month))
num_day = Number(day)
cluster = Cluster(srf_surfaces_to_analyze=srf_surfaces_to_analyze, int_analysis_subdivision="5")  # -> srf_subdivided_surface_2, pt_subdivision_points_2, vec_subdivision_normals_2
mjoin = MeshJoin(Meshes=geo_obstructions)
cluster_2 = Cluster_2(brep_building_to_analyze=brep_building_to_analyze, int_analysis_subdivision="10")  # -> srf_subdivided_surface_2, pt_subdivision_points_2, vec_subdivision_normals_2
subtraction = Subtraction(A=num_end_hour, B=num_start_hour)
vec_subdivision_normals = Vector(flatten(cluster.vec_subdivision_normals_2))
pt_subdivision_points = Point(flatten(cluster.pt_subdivision_points_2))
srf_subdivided_surface = Surface(flatten(cluster.srf_subdivided_surface_2))
vec_subdivision_normals_2 = Vector(flatten(cluster_2.vec_subdivision_normals_2))
srf_subdivided_surface_2 = Surface(flatten(cluster_2.srf_subdivided_surface_2))
pt_subdivision_points_2 = Point(flatten(cluster_2.pt_subdivision_points_2))
mesh_obstructions = Mesh(mjoin)
importlocation = Ladybug_ImportLocation(epwFile=path_weather_file)  # -> location; plug-in component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
series = Series(Start=num_start_hour, Step=1, Count=expr("X+1", subtraction))
num_day_2 = Number(num_day)
num_month_2 = Number(num_month)
sunpath = Ladybug_SunPath(location=importlocation, hour=series, day=num_day_2, month=num_month_2, timeStep=1, dailyOrAnnualSunPath=True)  # -> readMe, sunVectors, sunAltitudes, sunAzimuths, port, sunSpheresMesh, sunPathCrvs, compassCrvs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; plug-in component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
ladybug = Ladybug_Ladybug()  # -> Vviiiiiiiiiizzz; plug-in component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
vec_sun_vectors = Vector(sunpath.sunVectors)
vec_subdivision_normals_3 = Vector(vec_subdivision_normals_2)
srf_subdivided_surface_3 = Surface(srf_subdivided_surface_2)
pt_subdivision_points_3 = Point(pt_subdivision_points_2)
mesh_obstructions_2 = Mesh(mesh_obstructions)
amp = Amplitude(Vector=vec_subdivision_normals_3, Amplitude="2")
amp_2 = Amplitude(Vector=vec_subdivision_normals_3, Amplitude=".5")
move = Move(Geometry=pt_subdivision_points_3, Motion=amp)  # -> Geometry, Transform
move_2 = Move(Geometry=srf_subdivided_surface_3, Motion=amp_2)  # -> Geometry, Transform
occ = Occlusion(Samples=move.Geometry, Obstructions=mesh_obstructions_2, Rays=vec_sun_vectors)  # -> Hits, simplify(Occlusion)
not = GateNot(A=occ.Occlusion)
int_see_sun = Integer(not)
ma = MassAddition(Input=int_see_sun)  # -> Result, PartialResults
path_mapper = PathMapper(ma.Result, source=["{A;B}", "{A}"], target=["{B}", "{A}"])
avr = Average(Input=path_mapper)
larger = LargerThan(FirstNumber=avr, SecondNumber="3")  # -> LargerThan, OrEqualTo
lng = ListLength(List=flatten(avr))
ma_2 = MassAddition(Input=flatten(larger.OrEqualTo))  # -> Result, PartialResults
avr_2 = Average(Input=flatten(avr))
gradient = Gradient(LowerLimit="3", UpperLimit="10", Parameter=avr, stops=[0: RGB(64, 64, 64), 0.5: RGB(255, 255, 0), 1: RGB(255, 0, 0)])
srf_subdivided_surface_4 = Surface(graft(move_2.Geometry))
division = Division(A=ma_2.Result, B=lng)
average_daylight_hours = Panel(avr_2)
above_threshold = Panel(division)
preview = CustomPreview(Geometry=srf_subdivided_surface_4, Material=gradient)

# ==== cluster Cluster
srf_surfaces_to_analyze = ClusterInput()
int_analysis_subdivision = ClusterInput()
srf_surfaces_to_analyze_2 = Surface(graft(srf_surfaces_to_analyze))
int_analysis_subdivision_2 = Integer(int_analysis_subdivision)
dim = Dimensions(Surface=srf_surfaces_to_analyze_2)  # -> UDimension, VDimension
division = Division(A=dim.UDimension, B=int_analysis_subdivision_2)
division_2 = Division(A=dim.VDimension, B=int_analysis_subdivision_2)
divide = DivideDomain²(Domain=srf_surfaces_to_analyze_2, UCount=division, VCount=division_2)
subsrf = Isotrim(Surface=srf_surfaces_to_analyze_2, Domain=divide)
evalsrf = EvaluateSurface(Surface=reparameterize(subsrf), Point="{0.5,0.5,0}")  # -> Point, Normal, UDirection, VDirection, Frame
vec_subdivision_normals = Vector(evalsrf.Normal)
pt_subdivision_points = Point(evalsrf.Point)
srf_subdivided_surface = Surface(subsrf)
srf_subdivided_surface_2 = ClusterOutput(srf_subdivided_surface)
pt_subdivision_points_2 = ClusterOutput(pt_subdivision_points)
vec_subdivision_normals_2 = ClusterOutput(vec_subdivision_normals)

# ==== cluster Cluster_2
int_analysis_subdivision = ClusterInput()
brep_building_to_analyze = ClusterInput()
int_analysis_subdivision_2 = Integer(int_analysis_subdivision)
brep_building_to_analyze_2 = Brep(graft(brep_building_to_analyze))
debrep = DeconstructBrep(Brep=brep_building_to_analyze_2)  # -> Faces, Edges, Vertices
evalsrf = EvaluateSurface(Surface=debrep.Faces, Point="{0.5,0.5,0.5}")  # -> Point, Normal, UDirection, VDirection, Frame
devec = DeconstructVector(Vector=evalsrf.Normal)  # -> XComponent, YComponent, ZComponent
abs = Absolute(Value=devec.ZComponent)
smaller = SmallerThan(FirstNumber=abs, SecondNumber=".9")  # -> SmallerThan, OrEqualTo
cull = CullPattern(List=debrep.Faces, CullPattern=smaller.SmallerThan)
srf_surfaces_to_analyze = Surface(graft(cull))
dim = Dimensions(Surface=srf_surfaces_to_analyze)  # -> UDimension, VDimension
division = Division(A=dim.UDimension, B=int_analysis_subdivision_2)
division_2 = Division(A=dim.VDimension, B=int_analysis_subdivision_2)
divide = DivideDomain²(Domain=srf_surfaces_to_analyze, UCount=division, VCount=division_2)
subsrf = Isotrim(Surface=srf_surfaces_to_analyze, Domain=divide)
evalsrf_2 = EvaluateSurface(Surface=reparameterize(subsrf), Point="{0.5,0.5,0}")  # -> Point, Normal, UDirection, VDirection, Frame
srf_subdivided_surface = Surface(subsrf)
vec_subdivision_normals = Vector(evalsrf_2.Normal)
pt_subdivision_points = Point(evalsrf_2.Point)
srf_subdivided_surface_2 = ClusterOutput(srf_subdivided_surface)
pt_subdivision_points_2 = ClusterOutput(pt_subdivision_points)
vec_subdivision_normals_2 = ClusterOutput(vec_subdivision_normals)
